# Grasshopper definition AMv1_Inspect.gh (Grasshopper 1.0.8)

xy_plane = XYPlane(Origin=Point(0, 0, 0))
actuator_body = Geometry([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])
# Linear Actuator Model V1
actuator_pole = Geometry([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])

target_srf = Geometry(<surface referenced from the Rhino model>)
xy_plane_2 = XYPlane(Origin=Point(0, 0, 0))
platform_path = Panel("C:\Users\leeja\Documents\dev\26_AdaptiveMold_development")
width = Slider(1000, range=100..4000)
length = Slider(1000, range=100..4000)
spacing = Slider(200, range=50..500)
max_height = Slider(400, range=50..1000)
min_height = Slider(0, range=0..500)
pin_radius = Slider(20, range=0..100)
normalized = BooleanToggle(True)
compute = BooleanToggle(True)
robot_base_dir = Curve(<curve referenced from the Rhino model>)
robot_base_pt = Point(<point referenced from the Rhino model>)
amv1_inspect = GhPythonScript(
    platform_path=platform_path,
    target_srf=target_srf,
    base_plane=xy_plane_2,
    width=width,
    length=length,
    spacing=spacing,
    max_height=max_height,
    min_height=min_height,
    pin_radius=pin_radius,
    normalized=normalized,
    compute=compute)  # -> pins_ok, pins_clamped, pins_ext, pin_tops, deck, positioned, extended, envelope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; inputs platform_path: String, target_srf: Brep, base_plane: Plane, width: Double, length: Double, spacing: Double, max_height: Double, min_height: Double, pin_radius: Double, normalized: Boolean, compute: Boolean, wire_extend: Double, wire_d_main: Double, wire_d_sub: Double, sub_per_gap: Double, v_per_gap: Double, sheet_si_t: Double, sheet_ht_t: Double
#   port platform_path: 저장소 루트의 절대경로. 이 경로 아래 adaptive_mold/src 를 sys.path에 넣어 파이프라인을 불러온다. 예: C:\Users\leeja\Documents\dev\26_AdaptiveMold_development 필수 — 비어 있으면 아무것도 계산되지 않는다.
# ---------- amv1_inspect: Python ----------
# -*- coding: utf-8 -*-
# AMv1 Inspect — 몰드를 눈으로 보고 판단하기 위한 GhPython 컴포넌트
#
# 목적:
#   Phase B(곡면 정렬)의 회전 방식을 숫자가 아니라 형상으로 판단한다.
#   normalized 토글을 껐다 켜면서 몰드가 어떻게 달라지는지 본다.
#
#   normalized = False → 현재 구현 (진단상 기울기를 2배로 키움)
#   normalized = True  → fit 법선을 +Z 반구로 정규화한 뒤 +각도 회전
#
# GhPython 컴포넌트 Inputs (전부 item access, 없으면 기본값):
#   platform_path   str    repo root 경로 (필수)
#   target_srf      Surface/Brep  목표 곡면 (필수)
#   base_plane      Plane  기본 WorldXY
#   width           float  1000
#   length          float  1000
#   spacing         float  200
#   max_height      float  400
#   min_height      float  0
#   pin_radius      float  0 이면 spacing*0.12 자동
#   normalized      bool   False (현재 코드는 사용하지 않음 — 정규화가 본체가 됨)
#   wire_extend     float  강선 오버행, 없으면 250 (실물 관측 200~300)
#   wire_d_main     float  U 굵은 강선 지름, 없으면 12   ← 가정치
#   wire_d_sub      float  V·보조 U 강선 지름, 없으면 6  ← 가정치
#   sub_per_gap     int    굵은 U 사이 보조 U 개수, 없으면 2
#   v_per_gap       int    핀 열 사이 V 강선 개수, 없으면 2
#   sheet_si_t      float  실리콘 시트 두께, 없으면 8    ← 가정치
#   sheet_ht_t      float  내열 시트 두께, 없으면 2      ← 가정치
#   compute         bool   False
#
# Outputs:
#   pins_ok        정상 핀 (Brep)         — 회색 프리뷰 권장
#   pins_clamped   stroke 한계에 걸린 핀   — 빨강 권장
#   pins_ext       확장영역 핀             — 노랑 권장
#   pin_tops       핀 상단 점
#   wires          U방향 굵은 강선 (핀 위, 3차 보간곡선, 양 끝 오버행)
#   wires_sub      U방향 보조 강선 (굵은 것 사이, V 아래로 엮임)
#   wires_v        V방향 강선 (굵은 U 위를 가로지름)
#   sheet_si       실리콘 시트 상면 (= 내열 시트 하면)
#   sheet_ht       내열 시트 상면 = 실제 성형면
#   deck           핀 상단을 잇는 메시 (실제로 성형되는 면)
#   positioned     정렬된 목표 곡면
#   extended       확장된 곡면
#   envelope       stroke 범위 상자 (핀이 움직일 수 있는 공간)
#   deviation      핀 상단과 목표 곡면 사이 거리 (핀별)
#   info           통계 리포트

import sys
import os

import Rhino.Geometry as rg


# ── src 경로 등록 + 모듈 캐시 비우기 ────────────────────────
# Rhino의 Python은 프로세스가 살아 있는 동안 모듈을 캐시한다.
# src/를 고쳐도 반영되지 않으므로 매번 비운다.

_src = os.path.join(platform_path, "adaptive_mold", "src")
if _src not in sys.path:
    sys.path.insert(0, _src)

_norm = os.path.normcase(os.path.normpath(_src))
for _name in list(sys.modules.keys()):
    _p = getattr(sys.modules.get(_name), "__file__", None)
    if _p and os.path.normcase(os.path.normpath(_p)).startswith(_norm):
        del sys.modules[_name]

from adaptive_mold_v1 import run_adaptive_mold


# ── Guid 방어 ───────────────────────────────────────────
# GhPython 입력에 타입 힌트가 걸려 있지 않으면 Rhino 문서 객체가
# 지오메트리가 아니라 Guid로 넘어온다. 그러면 "target_srf is invalid"
# 또는 "expected Plane, got Guid"가 난다. 힌트가 정상이면 이 함수는
# 아무 일도 하지 않는다.

import System
import Rhino


def resolve(x):
    """Guid면 활성 Rhino 문서에서 지오메트리를 찾아 돌려준다."""
    if not isinstance(x, System.Guid):
        return x
    doc = Rhino.RhinoDoc.ActiveDoc
    if doc is None:
        return None
    obj = doc.Objects.FindId(x)
    return obj.Geometry if obj is not None else None


target_srf = resolve(target_srf)
base_plane = resolve(base_plane)


# ── 기본값 ──────────────────────────────────────────────

if base_plane is None:
    base_plane = rg.Plane.WorldXY
if width is None:
    width = 1000.0
if length is None:
    length = 1000.0
if spacing is None:
    spacing = 200.0
if max_height is None:
    max_height = 400.0
if min_height is None:
    min_height = 0.0
if not pin_radius:
    pin_radius = spacing * 0.12
if normalized is None:
    normalized = False

def _default(name, value, positive=False):
    """연결되지 않았거나 아직 파라미터가 없는 입력에 기본값을 넣는다.

    globals().get()을 쓰면 파라미터가 없어도 NameError가 나지 않는다 —
    컴포넌트에 입력을 추가하기 전에도 코드가 돈다.
    """
    g = globals()
    v = g.get(name)
    if v is None or (positive and v <= 0):
        g[name] = value


# 강선 오버행 — 액추에이터 영역 밖으로 더 나가는 길이.
# 실물 사진(image/adaptiveMold_image.png)에서 200~300mm로 관측된다.
# 주의: 강선을 따라 잰 길이다. 접선이 기울어져 있으면 수평 돌출은 이보다 짧다.
_default("wire_extend", 250.0, positive=True)

# 강선 지름과 밀도 — **전부 가정치.** 실물 장비 사양이 확정되면 교체할 것.
_default("wire_d_main", 12.0, positive=True)   # U 굵은 강선 (핀 위)
_default("wire_d_sub", 6.0, positive=True)     # V 강선 및 U 보조 강선
_default("sub_per_gap", 2)                     # 굵은 U 사이에 넣을 보조 U 개수
_default("v_per_gap", 2)                       # 핀 열 사이에 넣을 V 강선 개수
_default("sheet_si_t", 8.0, positive=True)     # 실리콘 시트 두께
_default("sheet_ht_t", 2.0, positive=True)     # 내열 시트 두께


pins_ok = []
pins_clamped = []
pins_ext = []
pin_tops = []
wires = []
wires_v = []
wires_sub = []
sheet_si = None
sheet_ht = None
deck = None
positioned = None
extended = None
envelope = None
deviation = []
info = ""


def make_pin(base_pt, normal, height, radius):
    """베이스 점에서 height 만큼 올라간 원기둥 하나."""
    if height <= 1e-9:
        height = 1e-9
    plane = rg.Plane(base_pt, normal)
    circle = rg.Circle(plane, radius)
    cyl = rg.Cylinder(circle, height)
    return cyl.ToBrep(True, True)


def make_deck_mesh(tops, nx, ny):
    """핀 상단을 잇는 쿼드 메시. 실제로 성형되는 면에 해당한다."""
    if len(tops) != nx * ny:
        return None
    mesh = rg.Mesh()
    for p in tops:
        mesh.Vertices.Add(p)
    for j in range(ny - 1):
        for i in range(nx - 1):
            a = j * nx + i
            b = a + 1
            c = a + nx + 1
            d = a + nx
            mesh.Faces.AddFace(a, b, c, d)
    mesh.Normals.ComputeNormals()
    mesh.Compact()
    return mesh


# ── 강선 메쉬 · 시트 적층 ─────────────────────────────────
#
# 적층 순서 (아래 → 위):
#   핀 상단 ─ U 굵은 강선(핀 위) ─ V 강선(굵은 U 위를 가로지름)
#            ─ U 보조 강선(V 아래로 엮임, 굵은 U 사이) ─ 실리콘 ─ 내열 시트
#
# 굵은 U와 보조 U는 **상단면이 같다** — 둘 다 V 강선의 밑면에 닿는다.
# 굵은 U는 핀이 받치고, 보조 U는 핀이 없어 V 강선에 엮여 매달린다.
#
# 강선 형상 두 가지 규칙:
#
# 1. **직선 폴리라인이 아니라 3차 보간곡선.** 탄성 스트립은 변형에너지(∫κ²)를
#    최소화하는 형상으로 안정되고 그 해가 자연 3차 스플라인이다. 직선 데크는
#    물리 모델이 아니라 상한선이며 새그를 26배 과대평가한다(J-004 FACT-01).
#
# 2. **오버행은 접선 직선**(`CurveExtensionStyle.Line`). 마지막 핀 바깥은
#    하중도 모멘트도 없는 자유단이라 직선이 된다. 곡률을 이어가는 Smooth
#    연장은 자유단에 모멘트가 남아 있다는 뜻이어서, 끝을 붙잡는 장치가
#    실제로 있을 때만 맞다.

def deck_surface(tops, nx, ny):
    """핀 상단을 지나는 쌍3차 곡면. (u,v)가 어느 인덱스인지 스스로 확인한다.

    `NurbsSurface.CreateThroughPoints(points, uCount, vCount, ...)`의 점 순서
    규약을 이름으로 추측하면 nx != ny일 때 U/V가 뒤바뀐 채로 그려지고,
    그림은 그럴듯하게 나오므로 한참 뒤에 발견된다. 그래서 두 조합을 만들어
    **모서리가 맞는 쪽**을 고른다.

    돌려주는 것: (surface, u_is_j)
      u_is_j=True  → u가 j(행, Y) 방향, v가 i(열, X) 방향
    """
    corner_j = tops[(ny - 1) * nx]      # i=0, j=max
    corner_i = tops[nx - 1]             # i=max, j=0
    for u_count, v_count, u_is_j in ((ny, nx, True), (nx, ny, False)):
        srf = rg.NurbsSurface.CreateThroughPoints(tops, u_count, v_count, 3, 3,
                                                  False, False)
        if srf is None:
            continue
        du, dv = srf.Domain(0), srf.Domain(1)
        want = corner_j if u_is_j else corner_i
        if srf.PointAt(du.T1, dv.T0).DistanceTo(want) < 1e-6:
            return srf, u_is_j
    return None, True


def _up_normal(srf, u, v, up):
    """곡면 법선을 up 쪽 반구로 정규화한다. 법선 방향은 보장되지 않는다."""
    n = srf.NormalAt(u, v)
    if n.IsValid and n * up < 0:
        n.Reverse()
    return n


def offset_iso(srf, u_is_j, along_x, const_param, dist, up, overhang,
               samples=48):
    """곡면의 아이소커브를 법선 방향으로 dist 띄운 곡선.

    곡면을 오프셋한 뒤 아이소커브를 뽑지 않는다 — 오프셋 곡면의 매개화가
    같다는 보장이 없다. 점을 샘플링해 각 점의 법선으로 옮기고 다시 보간한다.

    along_x=True 이면 X(=i) 방향 강선, False 이면 Y(=j) 방향 강선.
    """
    # X방향 강선은 (u_is_j일 때) v를 따라 변한다 → IsoCurve(1, u)
    iso_dir = 1 if (along_x == u_is_j) else 0
    iso = srf.IsoCurve(iso_dir, const_param)
    if iso is None:
        return None

    dom = iso.Domain
    pts = []
    for k in range(samples + 1):
        t = dom.T0 + dom.Length * k / float(samples)
        p = iso.PointAt(t)
        ok, u, v = srf.ClosestPoint(p)
        if not ok:
            continue
        pts.append(p + _up_normal(srf, u, v, up) * dist)
    if len(pts) < 4:
        return None

    crv = rg.Curve.CreateInterpolatedCurve(pts, 3)
    if crv is None:
        return None
    if overhang and overhang > 0:
        ext = crv.Extend(rg.CurveEnd.Both, overhang, rg.CurveExtensionStyle.Line)
        if ext is not None:
            crv = ext
    return crv


def offset_sheet(srf, tops_uv, nx, ny, dist, up):
    """핀 격자 위치의 점들을 법선으로 dist 띄워 만든 시트 곡면."""
    pts = []
    for (u, v) in tops_uv:
        pts.append(srf.PointAt(u, v) + _up_normal(srf, u, v, up) * dist)
    sheet, _ = deck_surface(pts, nx, ny)
    return sheet


def make_envelope(plane, w, l, hmin, hmax):
    """핀이 움직일 수 있는 공간. 여기를 벗어나면 클램핑이다."""
    box = rg.Box(plane,
                 rg.Interval(0, w),
                 rg.Interval(0, l),
                 rg.Interval(hmin, hmax))
    return box.ToBrep()


if compute and target_srf is not None:
    r = run_adaptive_mold(
        target_srf,
        base_plane=base_plane,
        width=width, length=length, spacing=spacing,
        max_height=max_height, min_height=min_height,
        compute=True,
        component=ghenv.Component,
    )

    positioned = r.positioned_srf
    extended = r.extended_srf
    pin_tops = list(r.pin_tops)
    envelope = make_envelope(base_plane, width, length, min_height, max_height)

    normal = base_plane.ZAxis
    for idx, (pt, h) in enumerate(zip(r.grid_pts, r.pin_heights)):
        pin = make_pin(pt, normal, h, pin_radius)
        if pin is None:
            continue
        if r.clamp_flags[idx]:
            pins_clamped.append(pin)
        elif r.extension_flags[idx]:
            pins_ext.append(pin)
        else:
            pins_ok.append(pin)

    nx = int(width // spacing) + 1
    ny = int(length // spacing) + 1
    deck = make_deck_mesh(pin_tops, nx, ny)

    # ── 강선 메쉬 ────────────────────────────────────────
    up = base_plane.ZAxis
    r_main = wire_d_main / 2.0
    r_sub = wire_d_sub / 2.0

    z_main = r_main                        # 굵은 U 중심 — 밑면이 핀 상단에 닿는다
    z_v = 2.0 * r_main + r_sub             # V 중심 — 굵은 U 위에 얹힌다
    z_sub = 2.0 * r_main - r_sub           # 보조 U 중심 — V 밑면에 닿는다
    mesh_top = 2.0 * r_main + 2.0 * r_sub  # 메쉬 상단 = V 강선 윗면

    srf0, u_is_j = deck_surface(pin_tops, nx, ny)

    if srf0 is not None:
        tops_uv = []
        for p in pin_tops:
            ok, u, v = srf0.ClosestPoint(p)
            tops_uv.append((u, v) if ok else (0.0, 0.0))

        def row_param(j):
            """X(=U)방향 강선의 상수 파라미터 — 행 j."""
            u, v = tops_uv[j * nx]
            return u if u_is_j else v

        def col_param(i):
            """Y(=V)방향 강선의 상수 파라미터 — 열 i."""
            u, v = tops_uv[i]
            return v if u_is_j else u

        def span(params, per_gap):
            """격자선 파라미터 사이에 per_gap개씩 끼운 목록."""
            out = []
            for k in range(len(params) - 1):
                a, b = params[k], params[k + 1]
                for m in range(1, per_gap + 1):
                    out.append(a + (b - a) * m / float(per_gap + 1))
            return out

        # 굵은 U — 핀 행마다 1본
        for j in range(ny):
            c = offset_iso(srf0, u_is_j, True, row_param(j), z_main, up,
                           wire_extend)
            if c is not None:
                wires.append(c)

        # 보조 U — 굵은 U 사이에 sub_per_gap개씩, V 강선 아래로
        for prm in span([row_param(j) for j in range(ny)], int(sub_per_gap)):
            c = offset_iso(srf0, u_is_j, True, prm, z_sub, up, wire_extend)
            if c is not None:
                wires_sub.append(c)

        # V — 핀 열마다 1본 + 열 사이에 v_per_gap개씩
        col_params = [col_param(i) for i in range(nx)]
        for prm in col_params + span(col_params, int(v_per_gap)):
            c = offset_iso(srf0, u_is_j, False, prm, z_v, up, wire_extend)
            if c is not None:
                wires_v.append(c)

        # 시트 — 메쉬 상단에 실리콘, 그 위에 내열. 출력은 각 시트의 상면이고
        # 내열 상면이 실제 성형면이다.
        sheet_si = offset_sheet(srf0, tops_uv, nx, ny,
                                mesh_top + sheet_si_t, up)
        sheet_ht = offset_sheet(srf0, tops_uv, nx, ny,
                                mesh_top + sheet_si_t + sheet_ht_t, up)

    # ── 이탈량 — 몰드 품질의 핵심 지표 ────────────────────
    #
    # 핀 상단을 재면 안 된다. 핀 높이는 목표 곡면에 레이캐스트해서 구하므로
    # 핀 상단은 정의상 곡면 위에 있고, 그 거리는 항상 0이다(동어반복).
    #
    # 실제로 재야 하는 것은 **핀과 핀 사이**다. 핀은 이산적인 지지점이고
    # 그 사이의 데크는 목표 곡면을 따라가지 못한다. 이 새그(sagitta)가
    # 몰드가 그 형상을 재현할 수 있는지를 말해준다.
    #   - 평면·단곡: 거의 0 (핀 격자로 잘 근사됨)
    #   - 안장형:    커짐 (핀 격자로 근사하기 어려운 형상)

    probe = positioned
    if probe is not None and not isinstance(probe, rg.Brep):
        probe = probe.ToBrep()

    if probe is not None and deck is not None:
        samples = []
        for f in range(deck.Faces.Count):
            samples.append(deck.Faces.GetFaceCenter(f))
        for e in range(deck.TopologyEdges.Count):
            ln = deck.TopologyEdges.EdgeLine(e)
            samples.append(ln.PointAt(0.5))
        for p in samples:
            cp = probe.ClosestPoint(p)
            deviation.append(p.DistanceTo(cp) if cp is not None else None)

    valid_dev = [d for d in deviation if d is not None]
    n_clamped = sum(1 for c in r.clamp_flags if c)
    n_ext = sum(1 for e in r.extension_flags if e)
    heights = [h for h in r.pin_heights if h is not None]

    branch_counts = {}
    for b in r.branch_taken:
        branch_counts[b] = branch_counts.get(b, 0) + 1

    stack_total = mesh_top + sheet_si_t + sheet_ht_t

    lines = [
        "AMv1 Inspect",
        "=" * 40,
        "그리드:      {} x {} = {} 핀".format(nx, ny, nx * ny),
        "stroke:      {:.0f} ~ {:.0f} mm".format(min_height, max_height),
        "",
        "핀 높이:     min={:.1f}  max={:.1f}  폭={:.1f} mm".format(
            min(heights) if heights else 0,
            max(heights) if heights else 0,
            (max(heights) - min(heights)) if heights else 0),
        "             <- 평면 패널이면 폭이 0이어야 정렬이 맞은 것",
        "클램핑:      {} / {}   <- 0이 아니면 그 지점은 목표를 재현 못 함".format(
            n_clamped, len(r.pin_heights)),
        "확장영역:    {} / {}   <- 원본 곡면 밖, 높이가 외삽값".format(
            n_ext, len(r.pin_heights)),
        "",
        "강선 메쉬:",
        "  U 굵은 (ø{:.0f}): {:>3}본  길이 {:.0f} mm  오버행 {:.0f} mm/끝(곡선따라)".format(
            wire_d_main, len(wires),
            max(c.GetLength() for c in wires) if wires else 0, wire_extend),
        "  U 보조 (ø{:.0f}): {:>3}본  굵은 강선 사이 {}개씩, V 아래로 엮임".format(
            wire_d_sub, len(wires_sub), int(sub_per_gap)),
        "  V      (ø{:.0f}): {:>3}본  핀 열마다 + 열 사이 {}개씩".format(
            wire_d_sub, len(wires_v), int(v_per_gap)),
        "  적층(핀 상단 기준): U중심 {:.1f} / 보조U중심 {:.1f} / V중심 {:.1f} / 메쉬상단 {:.1f} mm".format(
            z_main, z_sub, z_v, mesh_top),
        "  시트: 실리콘 {:.0f} + 내열 {:.0f}  ->  성형면 = 핀 상단 +{:.1f} mm".format(
            sheet_si_t, sheet_ht_t, stack_total),
        "  ** 핀 높이는 목표곡면에 맞춰 계산된다. 그 위에 스택이 얹히므로",
        "     성형면이 목표곡면보다 {:.1f} mm 위로 뜬다 — 핀 높이에서 그만큼".format(stack_total),
        "     빼야 맞는다. 지금은 미반영(Phase A~D 동작을 바꾸지 않기 위해).",
        "  ** 강선 지름·개수·시트 두께는 전부 가정치. 실물 사양 필요.",
        "",
        "핀 사이 새그: max={:.3f}  avg={:.3f} mm  ({}점 샘플)".format(
            max(valid_dev) if valid_dev else 0,
            sum(valid_dev) / len(valid_dev) if valid_dev else 0,
            len(valid_dev)),
        "             <- 핀 격자가 그 형상을 못 따라가는 정도",
        "폴백 가지:   {}".format(branch_counts),
        "",
        r.info,
    ]
    info = "\n".join(lines)

else:
    info = "compute=True 로 설정하고 target_srf를 연결하세요."
# ---------- end amv1_inspect ----------
toppoint = Point(amv1_inspect.pin_tops)
deconstruct = Deconstruct(Point=toppoint)  # -> XComponent, YComponent, ZComponent
construct_point = ConstructPoint(XCoordinate=deconstruct.XComponent, YCoordinate=deconstruct.YComponent, ZCoordinate=0)
actuator_body_2 = Orient(Geometry=actuator_body, Source=PlaneXY(0, 0, 0), Target=graft(construct_point))  # -> Geometry, Transform
actuator_pole_2 = Orient(Geometry=actuator_pole, Source=xy_plane, Target=graft(toppoint))  # -> Geometry, Transform
play = BooleanToggle(False)
loop = BooleanToggle(True)
amv1_rollerpath = AMv1RollerPath(platform_path=platform_path, mold_srf=amv1_inspect.sheet_ht, base_plane=xy_plane_2, compute=compute)  # -> out, paths, targets, roller_lines, contact, info, move_kind, path_full, path_air; inputs platform_path: String, mold_srf: Brep, base_plane: Plane, sheet_t: Double, roller_d: Double, roller_w: Double, stepover: Double, passes: Double, axis_mode: String, start_center: Boolean, compute: Boolean, zigzag: Boolean, clearance: Double, order_mode: String
#   port platform_path: 저장소 루트의 절대경로. adaptive_mold/src 의 toolpath 모듈을 불러온다. 필수.
# ---------- amv1_rollerpath: Python ----------
# -*- coding: utf-8 -*-
# AMv1 RollerPath — 로봇암 롤러가 금속 박판을 몰드면에 눌러 앉히는 경로
#
# 계산은 adaptive_mold/src/toolpath.py 에 있다. 이 컴포넌트는 얇은 어댑터다.
#
# Inputs (전부 item, 비우면 기본값):
#   platform_path  str      repo root (필수)
#   mold_srf       Surface/Brep  성형면 = 내열 시트 상면 (필수)
#   base_plane     Plane    몰드 베이스. 비우면 WorldXY
#   sheet_t        float    금속 박판 두께, 없으면 1.5
#   roller_d       float    롤러 지름, 없으면 60
#   roller_w       float    롤러 폭(접촉선 길이), 없으면 80
#   stepover       float    패스 간격, 0이면 roller_w*0.5
#   passes         int      점진 가압 패스 수, 없으면 1
#   axis_mode      str      auto | u | v  (진행 방향 강제)
#   start_center   bool     (구버전 호환) order_mode가 있으면 무시됨
#   order_mode     str      center-half | center-alt | sequential
#   zigzag         bool     왕복 진행, 없으면 True
#   clearance      float    접근·후퇴 높이, 없으면 30
#   compute        bool     False면 계산하지 않는다
#
# Outputs:
#   path_full      전체 툴패스 하나 (성형 + 접근/후퇴/이동이 이어진 것)
#   paths          성형 구간만
#   path_air       공중 구간만 (접근·후퇴·이동)
#   targets        로봇 타겟 Plane (실행 순서대로 평탄화)
#   move_kind      targets와 같은 순서의 구간 종류
#                  (approach / form / retract / link)
#   roller_lines   각 경로 시작점의 롤러 축 표시선
#   contact        판재-롤러 접촉점
#   info           진단 리포트

import sys
import os

import Rhino.Geometry as rg


_src = os.path.join(platform_path, "adaptive_mold", "src")
if _src not in sys.path:
    sys.path.insert(0, _src)

_norm = os.path.normcase(os.path.normpath(_src))
for _name in list(sys.modules.keys()):
    _p = getattr(sys.modules.get(_name), "__file__", None)
    if _p and os.path.normcase(os.path.normpath(_p)).startswith(_norm):
        del sys.modules[_name]

from toolpath import generate_roller_paths


def _default(name, value, positive=False):
    g = globals()
    v = g.get(name)
    if v is None or (positive and v <= 0):
        g[name] = value


_default("sheet_t", 1.5, positive=True)
_default("roller_d", 60.0, positive=True)
_default("roller_w", 80.0, positive=True)
_default("stepover", 0.0)
_default("passes", 1, positive=True)
_default("axis_mode", "auto")
_default("start_center", True)
_default("zigzag", True)
_default("clearance", 30.0)
# center-half 가 기본 — 중앙에서 바깥으로 미는 논리를 유지하면서 공중 이동이
# center-alt의 1/8.8이다 (실측 1,480 vs 13,000 mm).
_default("order_mode", "center-half")

if base_plane is None:
    base_plane = rg.Plane.WorldXY


path_full = None
paths = []
path_air = []
targets = []
move_kind = []
roller_lines = []
contact = []
info = ""


if compute and mold_srf is not None:
    r = generate_roller_paths(
        mold_srf,
        base_plane=base_plane,
        sheet_t=sheet_t,
        roller_d=roller_d,
        roller_w=roller_w,
        stepover=stepover,
        passes=int(passes),
        axis_mode=str(axis_mode),
        start_center=bool(start_center),
        zigzag=bool(zigzag),
        clearance=clearance,
        order_mode=str(order_mode),
    )

    path_full = r.path_full
    paths = r.paths
    path_air = r.paths_air
    roller_lines = r.roller_lines
    for group in r.targets:
        targets.extend(group)
    for group in r.move_kinds:
        move_kind.extend(group)
    for group in r.contact:
        contact.extend(group)

    d = r.info
    if d.get("error"):
        info = "오류: {}".format(d["error"])
    else:
        so = d.get("stepover_measured")
        seat_max = d.get("seat_error_max")
        lines = [
            "AMv1 RollerPath",
            "=" * 40,
            "진행 방향:   {} 매개방향  (축은 그 직각)".format(d["travel"]),
            "             <- 롤러는 진행 방향으로만 굽힘을 준다.",
            "                축 방향에 곡률이 있으면 접촉선이 앉지 않는다.",
            "",
            "패스:        {}본 x {}회 = {}개".format(
                d["n_paths_per_pass"], d["passes"], d["path_count"]),
            "타겟:        성형 {}개 + 이동 {}개 = {}개".format(
                d["form_targets"], d["air_targets"], d["target_count"]),
            "진행:        {}  순서 {}  (접근·후퇴 높이 {:.0f} mm)".format(
                "왕복 지그재그" if d["zigzag"] else "단방향",
                d["order_mode"], d["clearance"]),
            "패스간 이동: {} mm  합계 {:.0f} mm".format(
                "{:.0f} ~ {:.0f}".format(d["link_min"], d["link_max"])
                if d["link_min"] is not None else "?",
                d["link_total"]),
            "             <- 몰드면에서 간격을 유지하는 곡선이다. 직선으로 이으면",
            "                볼록면 위에서 현이 면 아래로 파고든다",
            "",
            "전체 경로:   {:.0f} mm  (성형 {:.0f} + 공중 {:.0f})  세그먼트 {}개".format(
                d["len_total"], d["len_form"], d["len_air"], d["full_segments"]),
            "             <- path_full 이 처음부터 끝까지 이어진 하나의 곡선이다",
            "간격:        설정 {:.1f} mm  실측 {} mm".format(
                d["stepover_set"],
                "{:.1f} ~ {:.1f}".format(so[0], so[1]) if so else "?"),
            "             <- 매개변수 등분이라 실측이 설정과 다를 수 있다",
            "롤러 중심:   접촉점에서 법선으로 {:.1f} mm (판두께 {:.1f} + 반지름 {:.1f})".format(
                d["roller_center_offset"], sheet_t, roller_d / 2.0),
            "",
            "접촉선 앉음: 최대 틈 {} mm  (롤러 폭 {:.0f} 기준)".format(
                "{:.3f}".format(seat_max) if seat_max is not None else "?",
                roller_w),
            "             <- 0에 가까울수록 선접촉. 커지면 점접촉이 되어",
            "                하중이 몰리고 판재에 흠이 난다. 형상 자체의",
            "                한계이지 경로 문제가 아니다 — 롤러 폭을 줄이거나",
            "                구면 공구로 바꿔야 한다.",
        ]
        if d.get("progressive_is_geometric"):
            lines += [
                "",
                "** 점진 가압 중간 깊이는 기하 가정이다.",
                "   실제 중간 형상은 해석(또는 실측) 없이는 알 수 없다.",
            ]
        lines += [
            "",
            "** 순서는 중앙 → 좌우 교대. 주름은 자유 경계에서 시작해 안으로",
            "   밀려오므로, 중앙을 먼저 앉히고 여분을 바깥으로 밀어낸다.",
        ]
        info = "\n".join(lines)
else:
    info = "compute=True 로 설정하고 mold_srf(성형면)를 연결하세요."
# ---------- end amv1_rollerpath ----------
geometry = Geometry(amv1_inspect.envelope)
geometry_2 = Geometry(amv1_inspect.deck)
geometry_3 = Geometry(amv1_inspect.positioned)
geometry_4 = Geometry(amv1_inspect.extended)
geometry_5 = Geometry(amv1_inspect.wires_sub)
geometry_6 = Geometry(amv1_inspect.wires_v)
geometry_7 = Geometry(amv1_inspect.pins_ok)
geometry_8 = Geometry(amv1_inspect.wires)
geometry_9 = Geometry(amv1_inspect.sheet_si)
geometry_10 = Geometry(amv1_inspect.sheet_ht)
stack = Slider(28, range=0..100)
check_hit = BooleanToggle(True)
hit_step = Slider(1, range=1..50)
hit_margin = Slider(30, range=0..1200)
roller_d = Slider(60, range=20..200)
feed = Slider(50, range=5..300)
joint_scale = Slider(0.25, range=0.05..1)
stack_2 = Slider(28, range=0..100)
check_hit_2 = BooleanToggle(True)
hit_margin_2 = Slider(30, range=0..200)
hit_step_2 = Slider(1, range=1..50)
pin_home = Slider(0, range=0..400)
pin_speed = Slider(50, range=5..300)
feed_2 = Slider(50, range=5..300)
joint_scale_2 = Slider(0.25, range=0.05..1)
dwell = Slider(1, range=0..10)
t = Slider(200, range=0..600)
time_scale = Slider(20, range=0.1..20)
fps = Slider(25, range=5..60)
show_path = BooleanToggle(True)
solo = BooleanToggle(True)
show_body = BooleanToggle(True)
panel = Panel(amv1_inspect.pins_clamped)
geometry_11 = Geometry(amv1_rollerpath.paths)
amv1_base = AMv1Base(
    platform_path=platform_path,
    targets=amv1_rollerpath.targets,
    base_pt=robot_base_pt,
    base_dir=robot_base_dir,
    pin_tops=amv1_inspect.pin_tops)  # -> out, plane, circle, overlap, info; inputs platform_path: String, targets: list of Plane, robot_base: Plane, base_pt: Point3d, base_dir: Curve, pin_tops: list of Point3d
#   port platform_path: 저장소 루트의 절대경로. 필수. AMv1 Inspect 와 같은 패널을 공유해 쓰면 된다.
# ---------- amv1_base: Python ----------
# -*- coding: utf-8 -*-
# AMv1 Base — 로봇 베이스 평면을 **한 곳에서** 정한다
#
# ──────────────────────────────────────────────────────────
# 왜 컴포넌트를 따로 두는가
# ──────────────────────────────────────────────────────────
#
# 베이스 평면은 Robot(계산)·Play(그림)·Check(판정)가 전부 필요하다. 각자
# `resolve_base_plane()` 을 부르면 코드는 한 곳이어도 **입력을 셋에 똑같이
# 물려야 하는 부담**이 남는다. 하나만 빼먹으면 오류가 나지 않고 **로봇이
# 계산된 위치와 다른 곳에 그려진다**(J-006 TRAP-03). 화면은 그럴듯한데
# 숫자가 다른 자리를 말하는, 가장 찾기 어려운 종류의 버그다.
#
# 그래서 여기서 한 번 정해 **Plane 하나로 내보낸다.** 받는 쪽은 판단하지 않는다.
# 이 컴포넌트를 안 물리면 아무것도 안 나오므로 빼먹으면 바로 드러난다.
#
# 우선순위는 robot.resolve_base_plane() 이 정한다:
#   robot_base(평면) > base_pt/base_dir(점·선) > 자동(타겟에서 유도)
#
# **로봇은 언제나 똑바로 선다.** 방향 벡터를 월드 XY 로 투영하므로 기울어진 선을
# 그어도 베이스가 눕지 않는다. 투영이 걸리면 info 에 적어 돌려준다.
#
# Inputs:
#   platform_path  str      repo root (필수)
#   targets        Plane*   AMv1 RollerPath 의 targets — 자동 방향·자동 위치용
#   robot_base     Plane    평면을 직접 줄 때. 최우선
#   base_pt        Point    베이스 원점 (Rhino 에서 점을 찍어 물린다)
#   base_dir       Curve    바라보는 방향 (Rhino 에서 선을 그어 물린다)
#                           **Curve 다.** Param_Line 은 Rhino 객체를 참조하지
#                           못해 값이 박히고, 선을 돌려도 방향이 안 바뀐다
#   pin_tops       Point3d* 핀 상단 — 몰드 발자국과의 겹침을 보기 위해 (list)
#
# Outputs:
#   plane      로봇 베이스 평면. Robot·Play·Check 에 **같은 것을** 물릴 것
#   circle     베이스 원통 발자국 (반경 630 mm 실측) — 배치 확인용
#   overlap    몰드 영역과의 겹침 깊이 (mm). 양수면 세울 수 없는 자리다
#   info       무엇으로 정했는지 + 겹침 판정

import sys
import os

import Rhino.Geometry as rg


_src = os.path.join(platform_path, "adaptive_mold", "src")
if _src not in sys.path:
    sys.path.insert(0, _src)

_norm = os.path.normcase(os.path.normpath(_src))
for _name in list(sys.modules.keys()):
    _p = getattr(sys.modules.get(_name), "__file__", None)
    if _p and os.path.normcase(os.path.normpath(_p)).startswith(_norm):
        del sys.modules[_name]

import robot as rb


tgts = [t for t in (targets or []) if t is not None]
pins = [p for p in (pin_tops or []) if p is not None]

plane, src = rb.resolve_base_plane(
    robot_base=robot_base, base_pt=base_pt, base_dir=base_dir,
    targets=tgts if tgts else None)

circle = rg.Circle(rg.Plane(plane.Origin, rg.Vector3d.ZAxis),
                   rb.BASE_RADIUS_MM)

# 겹침은 여기서 한 번만 본다 — IK 는 간섭을 모르므로, 겹치는 자리에서도
# 팔이 몰드를 통과해 닿는 것을 "도달 성공"으로 센다.
overlap = rb.base_overlap(plane, pins) if pins else None

lines = [
    "AMv1 Base",
    "=" * 44,
    "원점:        ({:.0f}, {:.0f}, {:.0f})".format(
        plane.Origin.X, plane.Origin.Y, plane.Origin.Z),
    "방향:        ({:+.3f}, {:+.3f})".format(plane.XAxis.X, plane.XAxis.Y),
    "출처:        {}".format(src),
    "발자국:      반경 {:.0f} mm (실측)".format(rb.BASE_RADIUS_MM),
]

if overlap is None:
    lines.append("몰드 겹침:   판정 못 함 — pin_tops 를 연결하세요")
elif overlap > 0:
    lines.append("몰드 겹침:   ** {:.0f} mm 겹친다 — 세울 수 없는 자리다".format(
        overlap))
    lines.append("             IK 는 간섭을 모르므로 팔이 몰드를 통과해 닿는")
    lines.append("             것을 '도달 성공'으로 센다. 베이스를 옮길 것")
else:
    lines.append("몰드 겹침:   없음 — {:.0f} mm 여유".format(-overlap))

lines.append("")
lines.append("이 plane 을 Robot 의 robot_base, Play·Check 에 **같이** 물릴 것.")
lines.append("각자 따로 정하면 오류 없이 서로 다른 자리를 계산한다.")

info = "\n".join(lines)
# ---------- end amv1_base ----------
amv1_robot = AMv1Robot(
    platform_path=platform_path,
    targets=amv1_rollerpath.targets,
    move_kind=amv1_rollerpath.move_kind,
    robot_base=amv1_base.plane,
    compute=compute,
    base_pt=robot_base_pt,
    base_dir=robot_base_dir)  # -> out, links, tcp, poses, reach_err, unreachable, info; inputs platform_path: String, targets: list, move_kind: list, robot_base: Plane, frame: Double, step: Double, iterations: Double, rot_weight: Double, compute: Boolean, base_pt: Point3d, base_dir: Curve
#   port platform_path: 저장소 루트의 절대경로. adaptive_mold/src/robot.py 를 불러온다.
# ---------- amv1_robot: Python ----------
# -*- coding: utf-8 -*-
# AMv1 Robot — IRB6700이 롤러 툴패스를 추종할 수 있는지 보고, 포즈를 만든다
#
# 기구학은 adaptive_mold/src/robot.py (웹 시뮬레이터에서 이식, 대조 완료).
#
# Inputs:
#   platform_path  str     repo root (필수)
#   targets        Plane*  AMv1 RollerPath 의 targets (list access)
#   move_kind      str*    같은 순서의 구간 종류 (선택). 있으면 구간별로 집계한다
#   robot_base     Plane   로봇 베이스 평면. 비우면 base_pt/base_dir 를 본다
#   base_pt        Point   베이스 원점 (Rhino 에서 점을 찍어 물린다)
#   base_dir       Curve   로봇이 바라보는 방향 (Rhino 에서 선을 그어 물린다)
#                          선만 주면 선의 시작점이 원점이 된다
#                          Line 이 아니라 Curve 로 받는다 — Rhino 의 선은
#                          LineCurve 객체이고 GH_Line 은 참조가 안 된다 떨어진 곳
#   frame          int     이 인덱스의 포즈로 로봇을 그린다 (애니메이션 슬라이더)
#   step           int     N개마다 하나만 계산, 없으면 1 (미리보기 가속)
#   iterations     int     IK 최대 반복, 없으면 30
#   rot_weight     float   자세 가중치, 없으면 0.4 (0이면 위치 전용)
#   compute        bool
#
# Outputs:
#   links          현재 frame 의 로봇 링크 선
#   tcp            현재 frame 의 TCP Plane
#   poses          전 구간 관절각 (6개씩 이어진 평탄 목록, deg)
#   reach_err      타겟별 위치 오차 (mm)
#   unreachable    오차가 큰 타겟의 인덱스
#   info           진단 리포트

import sys
import os

import Rhino.Geometry as rg


_src = os.path.join(platform_path, "adaptive_mold", "src")
if _src not in sys.path:
    sys.path.insert(0, _src)

_norm = os.path.normcase(os.path.normpath(_src))
for _name in list(sys.modules.keys()):
    _p = getattr(sys.modules.get(_name), "__file__", None)
    if _p and os.path.normcase(os.path.normpath(_p)).startswith(_norm):
        del sys.modules[_name]

import robot as rb


def _default(name, value, positive=False):
    g = globals()
    v = g.get(name)
    if v is None or (positive and v <= 0):
        g[name] = value


_default("frame", 0)
_default("step", 1, positive=True)
_default("iterations", 30, positive=True)
_default("rot_weight", 0.4)

REACH_TOL_MM = 2.0          # 이보다 크면 롤러가 표면에서 뜬 것으로 본다


links = []
tcp = None
poses = []
reach_err = []
unreachable = []
info = ""


if compute and targets:
    tgts = list(targets)

    # 베이스 위치 — 주지 않으면 몰드 중심에서 -X로 1900mm.
    # 웹 시뮬레이터가 베드를 X=1.4m에 두고 도달 스위트스폿을 확인한 값에서 왔다.
    # 베이스 결정은 robot.py 한 곳에 있다 — AMv1 Play 가 같은 함수를 써야
    # 로봇이 계산된 위치에 그려진다
    robot_base, base_src = rb.resolve_base_plane(
        robot_base=robot_base,
        base_pt=globals().get("base_pt"),
        base_dir=globals().get("base_dir"),
        targets=tgts)

    picked = list(range(0, len(tgts), int(step)))
    sampled = [tgts[i] for i in picked]

    pose_list, results, flips = rb.track_toolpath(
        sampled, base_plane=robot_base,
        iterations=int(iterations), rot_weight=rot_weight)

    for p in pose_list:
        for j in rb.JOINT_NAMES:
            poses.append(p[j])

    reach_err = [r.pos_err_mm for r in results]
    unreachable = [picked[i] for i, r in enumerate(results)
                   if r.pos_err_mm > REACH_TOL_MM]

    # 현재 프레임 그리기
    fi = int(frame)
    if fi < 0:
        fi = 0
    if fi >= len(pose_list):
        fi = len(pose_list) - 1
    links = rb.link_lines_mm(pose_list[fi], base_plane=robot_base)
    tcp = rb.tcp_plane_mm(pose_list[fi])
    tcp.Transform(rg.Transform.PlaneToPlane(rg.Plane.WorldXY, robot_base))

    # 집계
    at_limit = {}
    for r in results:
        for j in r.at_limit:
            at_limit[j] = at_limit.get(j, 0) + 1

    worst_i = 0
    for i, r in enumerate(results):
        if r.pos_err_mm > results[worst_i].pos_err_mm:
            worst_i = i

    seconds = rb.cycle_time(pose_list)

    kinds = {}
    if move_kind:
        mk = list(move_kind)
        for i, r in zip(picked, results):
            if i < len(mk):
                k = str(mk[i])
                cur = kinds.get(k, [0, 0.0])
                cur[0] += 1
                cur[1] = max(cur[1], r.pos_err_mm)
                kinds[k] = cur

    lines = [
        "AMv1 Robot — IRB 6700-150/3.20",
        "=" * 44,
        "베이스:      {}".format(base_src),
        "             원점 ({:.0f}, {:.0f}, {:.0f})  바라보는 방향 ({:.2f}, {:.2f})".format(
            robot_base.Origin.X, robot_base.Origin.Y, robot_base.Origin.Z,
            robot_base.XAxis.X, robot_base.XAxis.Y),
        "             <- AMv1 Play 에 같은 입력을 물려야 그림이 맞는다",
        "타겟:        {}개 중 {}개 계산 (step {})".format(
            len(tgts), len(sampled), int(step)),
        "",
        "위치 오차:   max {:.3f} mm  (타겟 #{})   평균 {:.3f} mm".format(
            max(reach_err) if reach_err else 0.0,
            picked[worst_i] if reach_err else -1,
            sum(reach_err) / len(reach_err) if reach_err else 0.0),
        "             <- {:.1f} mm 초과를 도달 실패로 본다".format(REACH_TOL_MM),
        "도달 실패:   {}개".format(len(unreachable)),
        "가동범위 접촉: {}".format(at_limit if at_limit else "없음"),
        "             <- 축이 한계에 걸리면 그 자세를 못 만든 것이다",
        "롤러 대칭 활용: {}회 뒤집음 / {}개".format(flips, len(sampled)),
        "             <- 원통 롤러는 축 부호가 무의미하다. 이 자유도를 쓰지",
        "                않으면 지그재그마다 손목이 180도씩 감긴다",
        "",
        "관절 이동시간: {:.1f} 초 ({:.1f} 분) — 전 구간을 관절 최대속도로 갔을 때".format(
            seconds, seconds / 60.0),
        "             <- 이것을 사이클 타임으로 읽지 말 것. 성형 구간의 속도는",
        "                로봇 능력이 아니라 공정(가열 판재의 이송 속도)이 정한다.",
        "                실제 시간은 AMv1 Play 의 duration 을 볼 것 —",
        "                실측 feed 50 mm/s 에서 592.8 초로 13.8배다.",
    ]
    if kinds:
        lines.append("")
        lines.append("구간별 최대 오차:")
        for k in sorted(kinds.keys()):
            n, e = kinds[k]
            lines.append("  {:<9} {:>5}개  max {:.3f} mm".format(k, n, e))
    if int(step) > 1:
        lines += [
            "",
            "** step>1 이면 이 오차는 신뢰할 수 없다.",
            "   IK가 앞 포즈를 시드로 쓰는데 타겟을 건너뛰면 시드가 멀어져",
            "   수렴이 깨진다 (실측: step=10에서 max 1,850 mm).",
            "   미리보기 전용으로만 쓰고 판정은 step=1 로 할 것.",
        ]
    if unreachable:
        lines += [
            "",
            "** 도달 실패가 있다. 오차가 큰 지점은 롤러가 표면에서 뜬다.",
            "   실측: base_x -1400/-1300/-1200 비교에서 -1400이 최선이었고,",
            "   가까이 옮기면 나빠진다. X 이동으로는 더 못 줄인다 —",
            "   몰드 회전·높이(z)·베이스 기울기를 봐야 한다.",
        ]
    info = "\n".join(lines)

else:
    info = "compute=True 로 설정하고 RollerPath 의 targets 를 연결하세요."
# ---------- end amv1_robot ----------
amv1_pathframes = AMv1PathFrames(targets=amv1_rollerpath.targets, move_kind=amv1_rollerpath.move_kind, pick=0)  # -> out, pts, normal, tool_axis, roller, travel, pts_form, pts_air, info, path; inputs targets: list, move_kind: list, every: Double, n_len: Double, roller_w: Double, pick: Double
#   port targets: RollerPath 의 targets. list access. Plane 목록은 화면에서 자세가 보이지 않으므로 이 컴포넌트가 벡터로 펼쳐서 보여준다.
# ---------- amv1_pathframes: Python ----------
# -*- coding: utf-8 -*-
# AMv1 PathFrames — 툴패스 타겟을 눈으로 읽을 수 있게 벡터로 펼친다
#
# targets 는 Plane 목록이라 화면에서 자세가 보이지 않는다. 각 타겟의
# 법선·롤러축·진행방향을 선으로 뽑아 경로가 곡면을 어떻게 따라가는지,
# 공구가 어디를 향하는지 확인한다.
#
# Inputs:
#   targets     Plane*  RollerPath 의 targets (list)
#   move_kind   str*    같은 순서의 구간 종류 (선택). 패스 분할에도 쓴다
#   pick        int     이 패스만 표시. -1(기본)이면 전체
#   every       int     N개마다 하나만 표시, 없으면 5
#   n_len       float   법선·진행 표시 길이, 없으면 60
#   roller_w    float   롤러 축 표시 길이, 없으면 80
#
# Outputs:
#   path        표시 대상 타겟을 순서대로 이은 폴리라인 — 로봇이 지나는 궤적
#   pts         타겟 원점 (= 롤러 중심)
#   normal      곡면 법선 방향 선 (바깥쪽) — 타겟의 -Z
#   tool_axis   공구 접근 방향 선 (곡면 쪽) — 타겟의 +Z
#   roller      롤러 축 선 (타겟의 Y, 길이 roller_w)
#   travel      진행 방향 선 (타겟의 X)
#   pts_form    성형 구간 점만
#   pts_air     공중 구간 점만 (approach/retract/link)
#   info        요약
#
# 전 구간(1,175개)을 한 번에 그리면 40mm 간격 패스 26본이 붉은 덩어리가 되어
# 아무것도 읽히지 않는다. pick 으로 한 패스씩 보는 것이 기본 사용법이다.

import Rhino.Geometry as rg


def _default(name, value, positive=False):
    g = globals()
    v = g.get(name)
    if v is None or (positive and v <= 0):
        g[name] = value


_default("every", 5, positive=True)
_default("n_len", 60.0, positive=True)
_default("roller_w", 80.0, positive=True)
_default("pick", -1)


path = None
pts = []
normal = []
tool_axis = []
roller = []
travel = []
pts_form = []
pts_air = []
info = ""


if targets:
    tg = list(targets)
    mk = [str(k) for k in move_kind] if move_kind else []
    n = int(every)

    # 패스 분할 — approach 가 새 패스의 시작이다. move_kind 가 없으면 전체 1개.
    bounds = [i for i, k in enumerate(mk) if k == "approach"]
    if not bounds:
        bounds = [0]
    spans = []
    for a, b in zip(bounds, bounds[1:] + [len(tg)]):
        spans.append((a, b))

    pi = int(pick)
    if 0 <= pi < len(spans):
        lo, hi = spans[pi]
        idx_all = list(range(lo, hi))
    else:
        pi = -1
        idx_all = list(range(len(tg)))

    idx = idx_all[::n]
    # 마지막 타겟은 항상 포함 — 경로 끝이 잘려 보이면 오해를 만든다
    if idx and idx_all and idx[-1] != idx_all[-1]:
        idx.append(idx_all[-1])

    for i in idx:
        pl = tg[i]
        o = pl.Origin
        z = rg.Vector3d(pl.ZAxis)          # 공구가 내려누르는 방향
        out = rg.Vector3d(z)
        out.Reverse()                      # 곡면 법선(바깥쪽)

        pts.append(o)
        normal.append(rg.Line(o, o + out * n_len))
        tool_axis.append(rg.Line(o, o + z * n_len))
        roller.append(rg.Line(o - pl.YAxis * (roller_w / 2.0),
                              o + pl.YAxis * (roller_w / 2.0)))
        travel.append(rg.Line(o, o + pl.XAxis * (n_len * 0.6)))

        kind = mk[i] if i < len(mk) else "form"
        if kind == "form":
            pts_form.append(o)
        else:
            pts_air.append(o)

    # 표시 대상을 순서대로 이은 궤적 — 이것이 "로봇이 지나는 경로"다
    if len(idx) > 1:
        path = rg.PolylineCurve([tg[i].Origin for i in idx])

    counts = {}
    for k in mk:
        counts[k] = counts.get(k, 0) + 1

    info = "\n".join([
        "AMv1 PathFrames",
        "=" * 40,
        "패스 {}개  |  선택 {}".format(
            len(spans), "전체" if pi < 0 else "#{} (타겟 {}~{})".format(
                pi, spans[pi][0], spans[pi][1] - 1)),
        "타겟 {}개 중 {}개 표시 (every {})".format(len(tg), len(pts), n),
        "성형 {} / 공중 {}".format(len(pts_form), len(pts_air)),
        "구간 구성(전체): {}".format(counts if counts else "move_kind 미연결"),
        "",
        "표시 규약:",
        "  path      = 표시 타겟을 순서대로 이은 궤적",
        "  normal    = 타겟 -Z, 곡면 바깥쪽 (길이 {:.0f})".format(n_len),
        "  tool_axis = 타겟 +Z, 공구가 내려누르는 방향",
        "  roller    = 타겟 Y, 접촉선 (길이 {:.0f})".format(roller_w),
        "  travel    = 타겟 X, 진행 방향",
        "",
        "** pick 에 0~{} 를 넣어 한 패스씩 볼 것.".format(max(0, len(spans) - 1)),
        "   전 구간을 한 번에 그리면 40mm 간격 패스가 겹쳐 덩어리로 보인다.",
    ])
else:
    info = "RollerPath 의 targets 를 연결하세요."
# ---------- end amv1_pathframes ----------
info = Panel(amv1_inspect.info)
amv1_check = AMv1Check(
    platform_path=platform_path,
    robot_plane=amv1_base.plane,
    poses=amv1_robot.poses,
    reach_err=amv1_robot.reach_err,
    targets=amv1_rollerpath.targets,
    move_kind=amv1_rollerpath.move_kind,
    pin_tops=amv1_inspect.pin_tops,
    feed=feed,
    joint_scale=joint_scale,
    mold_srf=amv1_inspect.sheet_ht,
    stack=stack_2,
    check_hit=check_hit_2,
    hit_margin=hit_margin_2,
    hit_step=hit_step_2)  # -> out, report, ok, warn, bad, j_margin, min_clear, min_override, fail_pts, hit_pts; inputs platform_path: String, robot_plane: Plane, poses: list of Double, reach_err: list of Double, targets: list of Plane, move_kind: list of String, pin_tops: list of Point3d, feed: Double, joint_scale: Double, mold_srf: Brep, stack: Double, parts_file: String, check_hit: Boolean, hit_margin: Double, hit_step: Int32
#   port platform_path: 저장소 루트의 절대경로. 필수. AMv1 Inspect 와 같은 패널을 공유해 쓰면 된다.
# ---------- amv1_check: Python ----------
# -*- coding: utf-8 -*-
# AMv1 Check — 이 경로를 이 로봇이 실제로 갈 수 있는가 (판정 전용)
#
# ──────────────────────────────────────────────────────────
# 왜 재생과 나누는가
# ──────────────────────────────────────────────────────────
#
# 판정과 재생은 **바뀌는 이유가 다르다.** 판정은 공학적 기준(가동범위·정격속도·
# 여유)이 바뀔 때, 재생은 보이는 방식(색·프레임률·무엇을 그릴지)이 바뀔 때
# 손댄다. 한 컴포넌트에 넣으면 색을 고치려다 판정을 깨고, 그 반대도 된다.
#
# 그리고 판정은 **무겁고 재생은 실시간이어야 한다.** 나눠 두면 재생을 돌리는
# 동안 판정을 다시 계산하지 않는다.
#
# 세 가지를 본다. 서로 다른 질문이고 손볼 곳도 다르다:
#
#   도달   그 점에 닿는가            -> 못 닿으면 경로·베이스 위치
#   기구   그렇게 움직일 수 있는가    -> 걸리면 베이스 위치·feed·오버라이드
#   간섭   몰드를 치지 않는가        -> 치면 베이스 위치·접근 높이
#
# ──────────────────────────────────────────────────────────
# 판정이 아니라 여유를 낸다
# ──────────────────────────────────────────────────────────
#
# "된다/안 된다"는 기준값을 어떻게 잡았는지에 달린 이진값이다. 위치를 잡을 때
# 필요한 것은 **얼마나 아슬아슬한가**다. 그래서 관절 여유(deg)·간섭 여유(mm)·
# 최소 오버라이드(%)를 각각 숫자로 낸다.
#
# `bad` 는 문제가 있는 구간 인덱스다. **Play 는 이유를 모른 채 그 구간을 다른
# 색으로 칠한다** — 판정 논리가 재생 쪽으로 새지 않게 하는 경계다.
#
# Inputs:
#   platform_path  str      repo root (필수)
#   robot_plane    Plane    AMv1 Base 의 plane. **Robot·Play 와 같은 것**
#   poses          float*   AMv1 Robot 의 poses (6개씩 평탄, list)
#   reach_err      float*   AMv1 Robot 의 reach_err — **연결할 것.**
#                           없으면 못 닿는 자리도 되는 것처럼 보인다
#   targets        Plane*   AMv1 RollerPath 의 targets (list)
#   move_kind      str*     같은 순서의 구간 종류 (list)
#   pin_tops       Point3d* 핀 상단 (list) — 몰드 발자국·높이장용
#   feed           float    롤러 이송 mm/s, 없으면 50            <- 가정치
#   joint_scale    float    프로그램 속도 오버라이드 0~1, 없으면 0.25
#   mold_srf       Brep     성형면. 있으면 높이장을 이것으로 만든다
#   stack          float    핀 상단에서 성형면까지 두께 (mm), 없으면 28
#   parts_file     str      로봇 파트 .3dm. 비우면 저장소 기본 경로
#   check_hit      bool     팔 간섭 스크리닝 실행, 없으면 False
#   hit_margin     float    간섭 여유 (mm), 없으면 30
#   hit_step       int      N개마다 하나만 검사, 없으면 1
#
# Outputs:
#   report       사람이 읽는 판정 리포트
#   ok           세 판정 모두 통과했는가 (bool)
#   warn         한 줄 경고 목록 — Play 의 warn 에 물려 HUD 에 띄운다
#   bad          문제가 있는 구간 인덱스 (int list) — Play 가 색으로 쓴다
#   j_margin     최소 관절 여유 (deg)
#   min_clear    최소 간섭 여유 (mm). 미검사면 없음
#   min_override feed 를 유지하는 최소 오버라이드 비율 (0~1)
#   fail_pts     못 닿는 타겟 점
#   hit_pts      팔이 몰드에 걸리는 자리의 타겟 점

import sys
import os

import Rhino.Geometry as rg
import scriptcontext as sc


_src = os.path.join(platform_path, "adaptive_mold", "src")
if _src not in sys.path:
    sys.path.insert(0, _src)

_norm = os.path.normcase(os.path.normpath(_src))
for _name in list(sys.modules.keys()):
    _p = getattr(sys.modules.get(_name), "__file__", None)
    if _p and os.path.normcase(os.path.normpath(_p)).startswith(_norm):
        del sys.modules[_name]

import robot as rb
import robot_body as rbb
import playback as pb
import collision as col
import mechanics as mc


def _default(name, value, positive=False):
    g = globals()
    v = g.get(name)
    if v is None or (positive and v <= 0):
        g[name] = value


_default("feed", pb.DEFAULT_FEED, positive=True)
_default("joint_scale", pb.DEFAULT_JOINT_SCALE, positive=True)
_default("stack", 28.0)
_default("check_hit", False)
_default("hit_margin", col.DEFAULT_MARGIN)
_default("hit_step", 1, positive=True)
_default("parts_file", "")

if not parts_file:
    parts_file = os.path.join(platform_path, "adaptive_mold", "grasshopper",
                              "irb6700_parts.3dm")

pose_flat = [float(v) for v in (poses or [])]
pose_list = pb.poses_from_flat(pose_flat) if pose_flat else []
tgts = [t for t in (targets or []) if t is not None]
tgt_pts = [t.Origin for t in tgts]
kinds = [str(k) for k in (move_kind or [])]
pins = [p for p in (pin_tops or []) if p is not None]
errs = [float(e) for e in (reach_err or [])]

warn = []
bad_set = set()

# 포즈와 타겟 개수가 다르면 어느 포즈가 어느 타겟인지 알 수 없다.
# 억지로 맞추면 엉뚱한 구간을 실패로 칠하게 되고 그게 더 나쁘다.
step_mismatch = bool(pose_list) and bool(tgt_pts) and \
    len(pose_list) != len(tgt_pts)
if step_mismatch:
    tgt_pts = []
    kinds = []
    warn.append("포즈 {}개 != 타겟 {}개 — Robot 이 step>1 로 돌았다".format(
        len(pose_list), len(tgts)))

err_mismatch = bool(errs) and bool(pose_list) and len(errs) != len(pose_list)
if err_mismatch:
    warn.append("reach_err 개수가 포즈와 달라 버렸다 — 도달 판정 못 함")
    errs = []


# ── 1. 도달 ────────────────────────────────────────────
fail_idx = [i for i, e in enumerate(errs) if e > pb.REACH_TOL_MM]
err_max = max(errs) if errs else None
fail_pts = [tgt_pts[i] for i in fail_idx if i < len(tgt_pts)]
for i in fail_idx:
    bad_set.add(i)
    if i > 0:
        bad_set.add(i - 1)          # 구간 양 끝 중 하나라도 못 닿으면 그 구간


# ── 2. 기구 ────────────────────────────────────────────
# 포즈 목록의 산술이라 값이 싸다 — 토글 없이 항상 돈다.
mech = None
if pose_list:
    mech = mc.check(pose_list, tgt_pts if tgt_pts else None,
                    kinds if kinds else None,
                    feed=float(feed), joint_scale=float(joint_scale))


# ── 3. 간섭 ────────────────────────────────────────────
# **검사가 아니라 스크리닝이다** — 표본으로 본다(collision.py 주석 참조).
PARTS_KEY = "AMv1_Check_parts"
PARTS = {}
parts_note = ""

hitfield = None
hit_sum = None
hit_pts = []

if check_hit and pose_list:
    if not os.path.isfile(parts_file):
        parts_note = "파트 파일이 없다"
    else:
        mt = os.path.getmtime(parts_file)
        cached = sc.sticky.get(PARTS_KEY)
        if cached and cached[0] == parts_file and cached[1] == mt:
            PARTS = cached[2]
            parts_note = "캐시"
        else:
            PARTS = rbb.load_parts(parts_file)
            sc.sticky[PARTS_KEY] = (parts_file, mt, PARTS)
            parts_note = "새로 읽음"

if check_hit and PARTS and pose_list:
    if mold_srf is not None:
        hitfield = col.Heightfield.from_surface(mold_srf, nx=40, ny=40)
    if hitfield is None and pins:
        # 핀 격자에서 만든다. 행 길이는 점 순서에서 유도한다 — 입력으로 받지
        # 않으면 잘못 연결될 여지가 없다.
        nx = len(pins)
        if len(pins) >= 3:
            d0 = pins[0].DistanceTo(pins[1])
            if d0 > 0:
                for i in range(1, len(pins) - 1):
                    if pins[i].DistanceTo(pins[i + 1]) > d0 * 1.5:
                        nx = i + 1
                        break
        ny = (len(pins) // nx) if nx else 0
        if nx >= 2 and ny >= 2:
            hitfield = col.Heightfield.from_grid_points(
                pins, nx, ny, offset=float(stack))

    if hitfield is not None:
        samples = col.sample_points(PARTS)
        pens, whos = col.scan_poses(
            pose_list, samples, hitfield, base_plane=robot_plane,
            margin=float(hit_margin), step=int(hit_step))
        hit_sum = col.summarize(pens, whos, step=int(hit_step),
                               total=len(pose_list), margin=float(hit_margin))
        for i in hit_sum["hit_indices"]:
            bad_set.add(i)
            if i < len(tgt_pts):
                hit_pts.append(tgt_pts[i])


# ── 판정 모으기 ────────────────────────────────────────
j_margin = mech["limits"]["worst"] if mech else None
min_override = mech["speed"]["min_override"] if mech else None
min_clear = hit_sum["min_clear"] if hit_sum else None
bad = sorted(bad_set)

# **통과도 적는다.** warn 은 경고 목록이 아니라 **HUD 에 띄울 판정 요약**이다.
# 통과를 안 적으면 화면에서 "판정했고 괜찮다"와 "판정 자체를 안 했다"가
# 구분되지 않는다 — 그 구분이 이 프로젝트에서 가장 자주 문제가 됐다.
if fail_idx:
    warn.append("도달 실패 {}개 / {}  최대 {:.1f} mm".format(
        len(fail_idx), len(errs), err_max))
elif not errs:
    warn.append("reach_err 미연결 — 도달 판정을 하지 못했다")
else:
    warn.append("도달 OK  최대 {:.2f} mm".format(err_max))

if mech:
    if mech["problems"]:
        warn.append("기구 문제: " + " / ".join(mech["problems"]))
    elif mech["tight"]:
        warn.append("기구 아슬아슬: " + " / ".join(mech["tight"]))

if hit_sum is not None:
    if hit_sum["hits"]:
        warn.append("팔 간섭 {}포즈  최대 {:.0f} mm".format(
            hit_sum["hits"], hit_sum["worst"]))
elif check_hit:
    warn.append("팔 간섭: 높이장을 못 만들었다 — mold_srf 나 pin_tops 확인")
else:
    warn.append("팔 간섭 미검사 (check_hit 를 켜세요)")

ok = bool(pose_list) and not fail_idx and bool(errs) \
    and (mech is not None and not mech["problems"]) \
    and (hit_sum is not None and not hit_sum["hits"])


# ── 리포트 ─────────────────────────────────────────────
lines = ["AMv1 Check", "=" * 44]

if not pose_list:
    lines.append("포즈가 없다 — AMv1 Robot 의 poses 를 연결하세요.")
else:
    lines.append("포즈 {}개 / 타겟 {}개".format(len(pose_list), len(tgts)))
    if robot_plane is not None:
        lines.append("베이스:      ({:.0f}, {:.0f}, {:.0f})  방향 ({:+.2f}, {:+.2f})".format(
            robot_plane.Origin.X, robot_plane.Origin.Y, robot_plane.Origin.Z,
            robot_plane.XAxis.X, robot_plane.XAxis.Y))
        lines.append("             <- AMv1 Base 에서 온 것. Robot·Play 와 같아야 한다")
    else:
        lines.append("** robot_plane 이 없다 — AMv1 Base 를 연결하세요.")
        lines.append("   없으면 로봇 좌표계로 계산해 전부 틀린 답이 나온다")

    lines.append("")
    lines.append("1. 도달")
    if not errs:
        lines.append("  reach_err 를 연결하지 않아 판정하지 못했다")
        lines.append("  <- 그러면 못 가는 위치도 되는 것처럼 보인다")
    else:
        lines.append("  실패 {}개 / {}개 ({:.1f}%)   최대 오차 {:.2f} mm".format(
            len(fail_idx), len(errs),
            100.0 * len(fail_idx) / len(errs), err_max))
        if fail_idx:
            lines.append("  <- 못 닿는 자세도 그려지기는 한다. IK 가 관절 한계에서")
            lines.append("     잘라내므로 화면에서는 그럴듯해 보인다")

    lines.append("")
    if mech:
        lines.append(mc.report(mech))
    else:
        lines.append("2. 기구: 포즈가 없어 판정하지 못했다")

    lines.append("")
    lines.append("3. 간섭")
    if hit_sum is not None:
        lines.append("  스크리닝 {}개 중 {}개 포즈 (여유 {:.0f} mm)".format(
            hit_sum["total"], hit_sum["checked"], float(hit_margin)))
        if hit_sum["min_clear"] is None:
            lines.append("  최소 여유: 판정 불가 (팔이 몰드 위를 지나지 않는다)")
        else:
            lines.append("  최소 여유: {:.0f} mm  <- margin 을 어떻게 잡아도 같은 값이다.".format(
                hit_sum["min_clear"]))
            lines.append("             형상이 정하는 실측값이므로 위치를 잡을 때")
            lines.append("             '얼마나 아슬아슬한가'를 이 숫자로 읽는다")
        if hit_sum["hits"]:
            lines.append("  걸림 {}포즈   최대 {:.0f} mm   처음 #{}".format(
                hit_sum["hits"], hit_sum["worst"], hit_sum["worst_at"]))
            for k in sorted(hit_sum["per_part"]):
                lines.append("    {:<10} {}포즈".format(
                    k, hit_sum["per_part"][k]))
        else:
            lines.append("  걸림 없음")
        lines.append("  ** 검사가 아니라 스크리닝이다. 표본으로 보므로 가느다란")
        lines.append("     돌출부는 빠져나갈 수 있다. 자기 간섭·프레임·주변")
        lines.append("     설비는 보지 않는다.")
        if hit_sum["step"] > 1:
            lines.append("  ** step={} 이라 사이 포즈는 보지 않았다.".format(
                hit_sum["step"]))
        if parts_note:
            lines.append("  파트 {}개 ({})".format(len(PARTS), parts_note))
    elif check_hit:
        lines.append("  높이장을 만들 수 없었다 — mold_srf 나 pin_tops 를 확인할 것")
        if parts_note:
            lines.append("  ({})".format(parts_note))
    else:
        lines.append("  미검사 (check_hit 를 켜면 훑는다)")

    lines.append("")
    lines.append("판정:        {}".format("통과" if ok else "걸림 또는 미판정"))
    for w in warn:
        lines.append("  - {}".format(w))
    lines.append("")
    lines.append("bad 구간 {}개 — Play 의 bad 에 물리면 그 구간을 다른 색으로".format(
        len(bad)))
    lines.append("그린다. warn 은 Play 의 warn 에 물려 HUD 에 띄운다.")

report = "\n".join(lines)
# ---------- end amv1_check ----------
amv1_play = AMv1Play(
    platform_path=platform_path,
    pin_tops=amv1_inspect.pin_tops,
    base_plane=xy_plane_2,
    pin_home=pin_home,
    pin_speed=pin_speed,
    poses=amv1_robot.poses,
    targets=amv1_rollerpath.targets,
    move_kind=amv1_rollerpath.move_kind,
    robot_plane=amv1_base.plane,
    warn=amv1_check.warn,
    bad=amv1_check.bad,
    feed=feed_2,
    joint_scale=joint_scale_2,
    dwell=dwell,
    t=t,
    play=play,
    loop=loop,
    time_scale=time_scale,
    fps=fps,
    roller_d=roller_d,
    show_path=show_path,
    solo=solo,
    show_body=show_body)  # -> out, pins, deck, links, body, tcp, roller, duration, info; inputs platform_path: String, pin_tops: list of Point3d, base_plane: Plane, pin_home: Double, pin_speed: Double, poses: list of Double, targets: list of Plane, move_kind: list of String, robot_plane: Plane, warn: list of String, bad: list of Int32, feed: Double, joint_scale: Double, dwell: Double, t: Double, play: Boolean, loop: Boolean, time_scale: Double, fps: Int32, roller_d: Double, show_path: Boolean, solo: Boolean, show_body: Boolean, parts_file: String
#   port platform_path: 저장소 루트의 절대경로. 필수. AMv1 Inspect 와 같은 패널을 공유해 쓰면 된다.
# ---------- amv1_play: Python ----------
# -*- coding: utf-8 -*-
# AMv1 Play — 핀 상승과 로봇 성형을 실제 시간으로 재생한다
#
# 시간 계산은 adaptive_mold/src/playback.py 에 있다. 이 컴포넌트는 그리기와
# 타이머 수명 관리를 한다.
#
# ──────────────────────────────────────────────────────────
# 왜 이런 구조인가 — Grasshopper 는 연속 재계산을 하지 않는다
# ──────────────────────────────────────────────────────────
#
# GH 는 입력이 바뀔 때 한 번 계산하고 멈춘다. 그래서 컴포넌트가 스스로
# 프레임을 넘기며 움직이게 만들 수 없다. 타이머로 ExpireSolution 을 걸면
# 되긴 하지만 매 프레임 IK 체인 전체가 다시 도므로 실시간이 안 된다.
#
# 그래서 재생은 **GH 밖에서** 한다:
#   1) 계산은 한 번만 (타임라인을 미리 만든다)
#   2) Rhino.Display.DisplayConduit 이 뷰포트에 직접 그린다
#   3) WinForms Timer 가 벽시계 시간으로 프레임을 넘긴다
#   4) 둘 다 scriptcontext.sticky 에 담아 솔루션 사이에 살려 둔다
#
# 실측(Rhino 8.33): interval 33 ms 설정에 22 Hz, PostDrawObjects 는 틱당
# 2.15회 호출된다(열린 뷰포트 수). 프레임 예산이 좁으므로 **선과 폴리라인만**
# 그린다. Brep 을 그리면 재생이 늘어진다.
#
# **System.Timers.Timer 를 쓰면 안 된다** — 스레드풀에서 돌아 UI 스레드가
# 아닌 곳에서 Redraw 를 호출하게 되고, 그러면 Rhino 가 불안정해진다.
# WinForms Timer 는 UI 스레드에서 Tick 한다.
#
# **컨듀잇은 항상 켜 둔다. 타이머만 재생 시에 돈다.**
#   play=False → 일시정지. t 슬라이더로 그 시점의 형상을 그린다
#   play=True  → 타이머가 벽시계 시간으로 프레임을 넘긴다
#
# 처음에는 정지 상태를 GH 출력 프리뷰에 맡겼는데, **GH 프리뷰가 메시 와이어를
# 전부 그려서** 12만 면이 붉은 철망으로 보였다(실측). 컨듀잇은 셰이딩된 몸체를
# 제 색으로 그린다. 두 모드가 같은 그림을 쓰는 편이 보기에도 낫고 코드도 하나다.
#
# 그래서 **자기 GH 프리뷰는 항상 끈다** — 켜 두면 컨듀잇 그림 위에 붉은 철망이
# 겹친다. 반면 `solo`(다른 컴포넌트 프리뷰 끄기)는 **재생 중에만** 적용한다.
# 정지 상태에서까지 남의 프리뷰를 꺼 두면 작업을 방해한다.
#
# **고아 컨듀잇 방지:** 컴포넌트를 지우면 솔루션이 돌지 않아 teardown 이 불리지
# 않는다. 그래서 컨듀잇이 매 프레임 자기 컴포넌트가 아직 문서에 있는지 확인하고,
# 없으면 스스로 꺼진다. 없으면 지운 뒤에도 뷰포트에 로봇이 남는다.
#
# Inputs:
#   platform_path  str      repo root (필수)
#   pin_tops       Point3d* AMv1 Inspect 의 pin_tops (list)
#   base_plane     Plane    몰드 베이스. 비우면 WorldXY
#   pin_home       float    핀 출발 높이, 없으면 0
#   pin_speed      float    액추에이터 속도 mm/s, 없으면 50   <- 가정치
#   poses          float*   AMv1 Robot 의 poses (6개씩 평탄, list)
#   targets        Plane*   AMv1 RollerPath 의 targets (list)
#   move_kind      str*     같은 순서의 구간 종류 (list)
#   robot_plane    Plane    **AMv1 Base 의 plane.** Robot·Check 와 같은 것
#   warn           str*     AMv1 Check 의 warn — HUD 에 그대로 띄운다 (list)
#   bad            int*     AMv1 Check 의 bad — 그 구간을 다른 색으로 (list)
#   feed           float    롤러 이송 mm/s, 없으면 50          <- 가정치
#   joint_scale    float    공중 이동 속도 배율 0~1, 없으면 0.25
#   dwell          float    핀 상승 후 정지 시간, 없으면 1.0
#   t              float    스크럽 시각(초). play=True 면 시작 시각
#   play           bool     재생 (Boolean Toggle 을 붙인다)
#   loop           bool     끝나면 처음으로, 없으면 False
#   time_scale     float    재생 배속. 1.0 이 실제 속도
#   fps            int      목표 프레임률, 없으면 25
#   roller_d       float    롤러 지름(표시용), 없으면 60
#   show_path      bool     지나온 경로를 그린다, 없으면 True
#   solo           bool     재생 중 다른 컴포넌트 프리뷰를 끈다, 없으면 True
#   show_body      bool     실물 메시로 그린다, 없으면 True
#   parts_file     str      irb6700_parts.3dm 경로. 비우면 저장소 기본 위치
#
# **판정은 여기 없다.** 도달·기구·간섭은 AMv1 Check 가 본다. 이 컴포넌트는
# Check 가 준 warn(문장)과 bad(구간 인덱스)를 그리기만 한다 — 이유를 모른다.
# 그래서 판정 기준이 바뀌어도 이 코드는 손대지 않는다.
#
# Outputs:
#   pins       t 시점의 핀 (선)
#   deck       t 시점의 핀 상단 격자 (폴리라인)
#   links      t 시점의 로봇 링크 (스틱 피겨)
#   body       t 시점의 로봇 실물 메시 (정지 상태에서만)
#   tcp        t 시점의 TCP Plane
#   roller     t 시점의 롤러 원
#   duration   전체 재생 길이 (초)
#   info       타임라인 리포트 + Check 가 준 경고 + 실측 프레임률

import sys
import os

import clr
try:
    clr.AddReference("System.Windows.Forms")
except Exception:
    pass

import System
import System.Drawing as sd
import System.Windows.Forms as wf

import Rhino
import Rhino.Geometry as rg
import Rhino.Display as rd
import scriptcontext as sc


_src = os.path.join(platform_path, "adaptive_mold", "src")
if _src not in sys.path:
    sys.path.insert(0, _src)

_norm = os.path.normcase(os.path.normpath(_src))
for _name in list(sys.modules.keys()):
    _p = getattr(sys.modules.get(_name), "__file__", None)
    if _p and os.path.normcase(os.path.normpath(_p)).startswith(_norm):
        del sys.modules[_name]

import robot as rb
import robot_body as rbb
import playback as pb


# sticky 키 — 컴포넌트가 여러 개 놓일 수 있으므로 인스턴스 GUID로 구분한다.
# 하나의 키를 공유하면 두 번째 컴포넌트가 첫 번째의 타이머를 죽인다.
KEY = "AMv1_Play_" + str(ghenv.Component.InstanceGuid)


def _default(name, value, positive=False):
    g = globals()
    v = g.get(name)
    if v is None or (positive and v <= 0):
        g[name] = value


_default("pin_home", 0.0)
_default("pin_speed", pb.DEFAULT_PIN_SPEED, positive=True)
_default("feed", pb.DEFAULT_FEED, positive=True)
_default("joint_scale", pb.DEFAULT_JOINT_SCALE, positive=True)
_default("dwell", 1.0)
_default("t", 0.0)
_default("play", False)
_default("loop", False)
_default("time_scale", 1.0, positive=True)
_default("fps", 25, positive=True)
_default("roller_d", 60.0, positive=True)
_default("show_path", True)
_default("solo", True)
_default("show_body", True)
_default("parts_file", "")

if base_plane is None:
    base_plane = rg.Plane.WorldXY

if not parts_file:
    parts_file = os.path.join(platform_path, "adaptive_mold", "grasshopper",
                              "irb6700_parts.3dm")


# ── 실물 형상 로드 (캐시) ───────────────────────────────
# 4 MB / 12만 면이라 솔루션마다 다시 읽으면 눈에 띄게 느리다.
# 파일 수정시각까지 키에 넣어, 파일을 다시 만들면 알아서 갱신된다.

PARTS_KEY = "AMv1_Play_parts"
PARTS = {}
parts_note = ""

if show_body:
    if not os.path.isfile(parts_file):
        parts_note = "파트 파일이 없다 — 스틱 피겨로 그린다"
    else:
        mt = os.path.getmtime(parts_file)
        cached = sc.sticky.get(PARTS_KEY)
        if cached and cached[0] == parts_file and cached[1] == mt:
            PARTS = cached[2]
            parts_note = "캐시"
        else:
            PARTS = rbb.load_parts(parts_file)
            sc.sticky[PARTS_KEY] = (parts_file, mt, PARTS)
            parts_note = "새로 읽음"
        missing = [n for n in rbb.PART_NAMES if n not in PARTS]
        if missing:
            parts_note += " (빠진 파트: {})".format(", ".join(missing))
else:
    parts_note = "show_body=False — 스틱 피겨"

# 밸런서 피벗을 **형상에서 유도한다.** 상수 기본값이 있지만, 메시를 들고 있으면
# 유도값이 정확하고 원본 GLB 가 바뀌어도 따라간다.
BAL = rbb.balancer_pivots_from_parts(PARTS) if PARTS else None
if BAL and BAL[0] is None:
    BAL = None


C_PIN_MOVING = sd.Color.FromArgb(255, 235, 140, 40)
C_PIN_DONE = sd.Color.FromArgb(255, 130, 140, 150)
C_DECK = sd.Color.FromArgb(255, 90, 150, 200)
C_ROBOT = sd.Color.FromArgb(255, 40, 44, 52)
C_ROLLER = sd.Color.FromArgb(255, 200, 60, 50)
C_DONE = sd.Color.FromArgb(255, 200, 60, 50)
C_TODO = sd.Color.FromArgb(255, 190, 195, 200)
C_HUD = sd.Color.FromArgb(255, 30, 30, 30)
# ABB 그래파이트 화이트 — URDF material rgba(0.9255, 0.9255, 0.9059)
C_BODY = sd.Color.FromArgb(255, 236, 236, 231)
# 못 닿는 구간 — 로봇을 다른 색으로 칠한다. 자세만 보고는 구별이 안 된다
C_BODY_BAD = sd.Color.FromArgb(255, 235, 150, 140)
C_BAD = sd.Color.FromArgb(255, 220, 20, 20)


# ── 이전 재생 정리 ──────────────────────────────────────
# **먼저 끈다.** 이 컴포넌트는 입력이 바뀔 때마다 다시 도는데, 정리하지 않으면
# 컨듀잇과 타이머가 계속 쌓여 화면에 여러 프레임이 겹쳐 그려지고 CPU를 먹는다.

def teardown():
    old = sc.sticky.pop(KEY, None)
    if old is None:
        return False
    try:
        old["conduit"].Enabled = False
    except Exception:
        pass
    tm = old.get("timer")
    if tm is not None:
        try:
            tm.Stop()
            tm.Dispose()
        except Exception:
            pass
    # 프리뷰를 원래대로 — **끈 것을 반드시 되돌린다.** 여기서 빠뜨리면
    # 재생을 멈춘 뒤에도 캔버스가 아무것도 안 보이는 상태로 남는다.
    for obj, was in old.get("hidden_prev", []):
        try:
            obj.Hidden = was
        except Exception:
            pass
    if old.get("hidden_prev"):
        try:
            ghenv.Component.OnPingDocument().ExpirePreview(True)
        except Exception:
            pass
    return True


def hide_previews(others):
    """재생 중 GH 프리뷰를 끈다. (객체, 원래값) 목록을 돌려준다.

    **자기 프리뷰는 항상 끈다.** 이 컴포넌트의 pins·deck 출력은 t 시점의
    형상인데, 재생 중에는 t 가 고정이라 **틀린 그림이 화면에 남는다**(실측:
    t=0 으로 재생을 시작하니 바닥에 납작한 격자가 그려져 있었다).
    움직이는 그림은 컨듀잇이 그리므로 출력 프리뷰는 방해만 된다.

    others=True 면 다른 컴포넌트도 끈다. 핀 Brep·강선·법선 화살표·롤러선이
    화면을 덮으면 재생이 보이지 않는다 — 이것도 실측이다.

    끄는 것이 아니라 **끈 것을 기억해 두는 것**이 요점이다. teardown 이 되돌린다.
    """
    prev = []
    me = ghenv.Component
    try:
        ghdoc = me.OnPingDocument()
    except Exception:
        ghdoc = None

    targets_ = [me]
    if others and ghdoc is not None:
        targets_ = [o for o in ghdoc.Objects]

    for o in targets_:
        try:
            was = o.Hidden          # IGH_PreviewObject 만 갖고 있다
        except Exception:
            continue
        prev.append((o, was))
        try:
            o.Hidden = True
        except Exception:
            pass

    if ghdoc is not None:
        try:
            ghdoc.ExpirePreview(True)
        except Exception:
            pass
    return prev


teardown()


# ── 입력 정리 ───────────────────────────────────────────

pin_pts = [p for p in (pin_tops or []) if p is not None]
pose_flat = [float(v) for v in (poses or [])]
tgts = [p for p in (targets or []) if p is not None]
kinds = [str(k) for k in (move_kind or [])]

pin_bases = []
pin_h_end = []
if pin_pts:
    for p in pin_pts:
        u, v = 0.0, 0.0
        ok, u, v = base_plane.ClosestParameter(p)
        b = base_plane.PointAt(u, v)
        pin_bases.append(b)
        # 높이는 베이스면 법선 방향 거리 — 평면이 기울어도 맞는다
        pin_h_end.append((p - b) * base_plane.ZAxis)

pin_h_start = [float(pin_home)] * len(pin_bases)


def derive_nx(pts):
    """행 길이(nx)를 점 순서에서 유도한다.

    그리드는 row-major(idx = j*nx + i)이고 한 행 안에서는 간격이 일정하다.
    행이 바뀌는 지점에서 연속 두 점의 거리가 크게 뛴다 — 그 지점이 nx다.
    이렇게 하면 nx 를 입력으로 받지 않아도 되고, 잘못 연결될 여지가 없다.
    """
    if len(pts) < 3:
        return len(pts)
    d0 = pts[0].DistanceTo(pts[1])
    if d0 <= 0:
        return len(pts)
    for i in range(1, len(pts) - 1):
        if pts[i].DistanceTo(pts[i + 1]) > d0 * 1.5:
            return i + 1
    return len(pts)


NX = derive_nx(pin_bases) if pin_bases else 0
NY = (len(pin_bases) // NX) if NX else 0


# ── 타임라인 ────────────────────────────────────────────

pose_list = pb.poses_from_flat(pose_flat) if pose_flat else []
tgt_pts = [p.Origin for p in tgts]

# 로봇 포즈와 타겟 수가 다르면 AMv1 Robot 이 step>1 로 돌았다는 뜻이다.
# 그 경우 거리 기반 이송 시간을 타겟에 맞출 수 없다 — 관절 시간만 쓴다.
step_mismatch = bool(pose_list) and bool(tgt_pts) and len(pose_list) != len(tgt_pts)
if step_mismatch:
    tgt_pts = []
    kinds = []

# **베이스는 여기서 정하지 않는다.** AMv1 Base 가 정한 평면을 그대로 받는다.
# 예전에는 이 컴포넌트가 robot_base/base_pt/base_dir 로 직접 판단했는데, 그러면
# Robot·Check 에 같은 입력을 물려야 하는 부담이 남고, 하나만 빼먹으면 오류 없이
# **로봇이 계산된 위치와 다른 곳에 그려진다**(J-006 TRAP-03).
# 이제 안 물리면 로봇이 원점에 서므로 빼먹은 것이 화면에 바로 드러난다.
robot_plane_given = robot_plane is not None
if robot_plane is None:
    robot_plane = rg.Plane.WorldXY

timeline = pb.build(
    pin_bases=pin_bases, pin_h_start=pin_h_start, pin_h_end=pin_h_end,
    pin_speed=pin_speed,
    poses=pose_list, kinds=kinds, points=tgt_pts,
    feed=feed, joint_scale=joint_scale, dwell=dwell)

duration = timeline.duration

base_circle = rg.Circle(
    rg.Plane(robot_plane.Origin, rg.Vector3d.ZAxis), rb.BASE_RADIUS_MM)


# ── 문제 구간 ──────────────────────────────────────────
# **판정은 AMv1 Check 가 한다.** 여기는 이유를 모른 채 색만 칠한다 — 도달
# 실패인지 간섭인지 구분하지 않는다. 그 구분이 필요하면 Check 의 리포트를 본다.
# 이렇게 두면 판정 기준이 바뀌어도 이 컴포넌트를 손대지 않는다.
BAD = set(int(v) for v in (bad or []))


# ── 프레임 하나를 형상으로 ─────────────────────────────

def build_frame(t):
    """t초 시점의 표시 형상. 재생과 스크럽이 같은 코드를 쓴다."""
    s = timeline.sample(t)

    pin_lines = []
    moving = []
    hs = s["heights"]
    if hs:
        for b, h, h1 in zip(pin_bases, hs, pin_h_end):
            top = b + base_plane.ZAxis * h
            pin_lines.append(rg.Line(b, top))
            moving.append(abs(h - h1) > 1e-6)

    deck = []
    if hs and NX >= 2 and NY >= 1:
        tops = [b + base_plane.ZAxis * h for b, h in zip(pin_bases, hs)]
        for j in range(NY):
            row = tops[j * NX:(j + 1) * NX]
            if len(row) >= 2:
                deck.append(rg.Polyline(row))
        for i in range(NX):
            col = [tops[j * NX + i] for j in range(NY)]
            if len(col) >= 2:
                deck.append(rg.Polyline(col))

    lks = []
    tcp_pl = None
    roller_crv = None
    part_xf = {}
    pose = s["pose"]
    if pose is not None:
        lks = rb.link_lines_mm(pose, base_plane=robot_plane)
        tcp_pl = rb.tcp_plane_mm(pose)
        tcp_pl.Transform(rg.Transform.PlaneToPlane(rg.Plane.WorldXY, robot_plane))
        # 롤러는 축(TCP X)에 직각인 원이다
        roller_crv = rg.Circle(
            rg.Plane(tcp_pl.Origin, tcp_pl.XAxis), roller_d / 2.0)
        if PARTS:
            # 변환만 만든다 — **메시를 복제하지 않는다.** 프레임마다 12만 면을
            # 복제하면 재생이 늘어진다. 그리기는 PushModelTransform 이 한다.
            part_xf = rbb.part_transforms(pose, base_plane=robot_plane,
                                          balancer=BAL)

    return {"s": s, "pins": pin_lines, "moving": moving, "deck": deck,
            "links": lks, "tcp": tcp_pl, "roller": roller_crv,
            "part_xf": part_xf, "bad": (s["seg"] in BAD)}


# ── 컨듀잇 ──────────────────────────────────────────────

class PlayConduit(rd.DisplayConduit):
    """벽시계 시간으로 프레임을 그린다. 상태는 state dict 에 둔다."""

    def __init__(self, state):
        self.state = state

    def CalculateBoundingBox(self, e):
        # 이걸 빼면 그린 것이 뷰 클리핑에 걸려 잘린다 — 카메라가 우리 형상을
        # 모르기 때문이다. ZoomExtents 도 반응하지 않는다.
        bb = self.state.get("bbox")
        if bb is not None and bb.IsValid:
            e.IncludeBoundingBox(bb)

    def PostDrawObjects(self, e):
        st = self.state

        # 컴포넌트가 지워졌으면 스스로 꺼진다 — 지우면 솔루션이 돌지 않아
        # teardown 이 불리지 않고, 그대로 두면 뷰포트에 로봇이 남는다.
        try:
            if st["comp"].OnPingDocument() is None:
                self.Enabled = False
                return
        except Exception:
            self.Enabled = False
            return

        sw = st["sw"]
        t0 = sw.Elapsed.TotalMilliseconds

        f = st["frame"]
        s = f["s"]
        d = e.Display

        for ln, mv in zip(f["pins"], f["moving"]):
            d.DrawLine(ln, C_PIN_MOVING if mv else C_PIN_DONE, 3)
        for pl in f["deck"]:
            d.DrawPolyline(pl, C_DECK, 1)

        if st["show_path"] and st["tgt_pts"]:
            seg = s["seg"]
            if s["phase"] in ("robot", "done") and seg >= 1:
                d.DrawPolyline(st["tgt_pts"][:seg + 1], C_DONE, 2)
            if seg + 1 < len(st["tgt_pts"]):
                d.DrawPolyline(st["tgt_pts"][seg:], C_TODO, 1)

        # ── 문제 구간 표시 ──────────────────────────────
        # **문제가 있는 자세도 멀쩡하게 그려진다.** IK 가 관절 한계에서
        # 잘라내므로 팔은 그럴듯한 자세로 서 있고 롤러만 판재에서 떠 있다.
        # 눈으로 구별이 안 되므로 명시적으로 그린다.
        # 어떤 문제인지는 여기서 알 필요가 없다 — AMv1 Check 가 준 목록이다.
        bad = f["bad"]
        if st["bad_pts"]:
            d.DrawPoints(st["bad_pts"], rd.PointStyle.X, 4, C_BAD)

        d.DrawCircle(st["base_circle"], C_PIN_DONE, 2)
        if bad and f["tcp"] is not None and st["tgt_pts"]:
            seg = min(s["seg"], len(st["tgt_pts"]) - 1)
            # TCP 와 가려던 자리를 잇는다 — 이 선의 길이가 곧 오차다
            d.DrawLine(rg.Line(f["tcp"].Origin, st["tgt_pts"][seg]), C_BAD, 3)
            d.DrawPoint(st["tgt_pts"][seg], rd.PointStyle.RoundControlPoint,
                        6, C_BAD)

        # ── 실물 형상 ────────────────────────────────────
        # **메시를 옮기지 않고 좌표계를 옮긴다.** Push/Pop 이면 원본을 그대로
        # 그릴 수 있어 프레임마다 12만 면을 복제하지 않는다.
        parts = st["parts"]
        drew_body = False
        if parts and f["part_xf"]:
            mat = st["material_bad"] if bad else st["material"]
            for name, mesh in parts.items():
                xf = f["part_xf"].get(name)
                if xf is None:
                    continue
                d.PushModelTransform(xf)
                try:
                    d.DrawMeshShaded(mesh, mat)
                finally:
                    d.PopModelTransform()
            drew_body = True

        # 스틱 피겨는 실물이 없을 때만 — 겹치면 실물 안쪽에 선이 비쳐 지저분하다
        if not drew_body:
            for ln in f["links"]:
                d.DrawLine(ln, C_BAD if bad else C_ROBOT, 5)

        if f["roller"] is not None:
            d.DrawCircle(f["roller"], C_ROLLER, 3)

        # HUD — 실제 시간으로 도는지 눈으로 확인할 수 있어야 한다
        if st["running"]:
            head = "{:6.2f} / {:.1f} s   x{:.0f}   {}".format(
                s["t"], st["duration"], st["time_scale"], s["phase"])
            tail = "{:3.0f}%   {:.1f} fps   draw {:.2f} ms x{:.1f}".format(
                s["progress"] * 100.0, st["fps_measured"],
                st["draw_ms"], st["draws_per_frame"])
        else:
            head = "||  {:6.2f} / {:.1f} s   {}".format(
                s["t"], st["duration"], s["phase"])
            tail = "{:3.0f}%   play 를 켜면 실제 속도로 돈다".format(
                s["progress"] * 100.0)
        txt = [head, tail]
        for i, line in enumerate(txt):
            d.Draw2dText(line, C_HUD, rg.Point2d(14, 16 + i * 18), False, 14)

        # ── 경고 ────────────────────────────────────────
        # **문장을 만들지 않는다.** AMv1 Check 가 준 줄을 그대로 띄운다.
        # 판정 문구를 여기서 다시 쓰면 두 컴포넌트가 서로 다른 말을 하게 된다.
        # 경고가 하나도 없으면 Check 를 안 물렸다는 뜻이므로 그렇게 적는다.
        y = 16 + len(txt) * 18
        notes = st["warn"]
        if not notes:
            d.Draw2dText("판정 없음 — AMv1 Check 의 warn 을 연결하세요",
                         C_BAD, rg.Point2d(14, y), False, 14)
            y += 18
        else:
            for w in notes:
                d.Draw2dText(w, C_BAD if "**" in w or "문제" in w or "실패" in w
                             else C_TODO,
                             rg.Point2d(14, y), False, 14)
                y += 18
        if bad:
            d.Draw2dText("<< 지금 이 구간이 문제 구간이다 (Check 의 bad)",
                         C_BAD, rg.Point2d(14, y), False, 14)

        st["draw_ms"] = sw.Elapsed.TotalMilliseconds - t0
        st["draws"] += 1


# ── 표시 (항상) + 재생 (play 일 때) ────────────────────

frame = build_frame(float(t))
s0 = frame["s"]
pins = frame["pins"]
deck = frame["deck"]
links = frame["links"]
tcp = frame["tcp"]
roller = frame["roller"]

# 실물 메시 출력. **프리뷰로 보이는 것이 아니다** — 자기 프리뷰는 껐고 화면은
# 컨듀잇이 그린다. 이 출력은 다른 컴포넌트로 넘겨 쓸 때를 위한 것이다.
body = []
if PARTS and frame["part_xf"]:
    body = [m for _n, m in rbb.posed_meshes(
        PARTS, s0["pose"], base_plane=robot_plane, balancer=BAL)]

running = bool(play) and duration > 0

all_pts = list(pin_bases)
for b, h in zip(pin_bases, pin_h_end):
    all_pts.append(b + base_plane.ZAxis * h)
for ln in links:
    all_pts.append(ln.From)
    all_pts.append(ln.To)
all_pts.extend(tgt_pts)
# 실물 형상은 링크 선보다 크다 — 베이스 반경과 팔 두께만큼 더 잡는다
all_pts.append(robot_plane.Origin)
bbox = rg.BoundingBox(all_pts) if all_pts else rg.BoundingBox.Unset
if bbox.IsValid:
    bbox.Inflate(1200.0 if PARTS else 500.0)

state = {
    "frame": frame,
    "comp": ghenv.Component,
    "parts": PARTS,
    "material": rd.DisplayMaterial(C_BODY),
    "material_bad": rd.DisplayMaterial(C_BODY_BAD),
    "base_circle": base_circle,
    "warn": [str(w) for w in (warn or [])],
    # 문제 구간의 타겟 위치 — 경로 어디가 문제인지 한눈에 보이게
    "bad_pts": [tgt_pts[i] for i in sorted(BAD) if i < len(tgt_pts)],
    "sw": System.Diagnostics.Stopwatch.StartNew(),
    "t0": float(t),
    "duration": duration,
    "time_scale": float(time_scale),
    "loop": bool(loop),
    "running": running,
    "show_path": bool(show_path),
    "tgt_pts": tgt_pts,
    "bbox": bbox,
    "draws": 0,
    "draw_ms": 0.0,
    "ticks": 0,
    "fps_measured": 0.0,
    "draws_per_frame": 0.0,
    "last_fps_t": 0.0,
    "last_fps_draws": 0,
    "last_fps_ticks": 0,
}

# 자기 프리뷰는 항상 끈다(컨듀잇 그림 위에 붉은 철망이 겹친다).
# 남의 프리뷰는 재생 중에만 끈다 — 정지 상태에서까지 꺼 두면 작업을 방해한다.
state["hidden_prev"] = hide_previews(bool(solo) and running)

conduit = PlayConduit(state)
conduit.Enabled = True

timer = None
info_extra = []

if running:

    def on_tick(sender, args):
        st = state
        st["ticks"] += 1
        secs = st["sw"].Elapsed.TotalSeconds
        t_now = st["t0"] + secs * st["time_scale"]

        if t_now > st["duration"]:
            if st["loop"]:
                st["t0"] = 0.0
                st["sw"].Restart()
                t_now = 0.0
            else:
                t_now = st["duration"]

        st["frame"] = build_frame(t_now)

        # 실측 프레임률 — 0.5초마다 갱신.
        # **프레임은 틱이고, 그리기는 뷰포트마다 한 번씩 더 일어난다.**
        # draws 로 fps 를 계산하면 열린 뷰포트 수만큼 부풀어 보인다
        # (실측: 21.2 fps 인데 draws 기준으로는 36.7 로 나왔다).
        dt_fps = secs - st["last_fps_t"]
        if dt_fps >= 0.5:
            dticks = st["ticks"] - st["last_fps_ticks"]
            ddraws = st["draws"] - st["last_fps_draws"]
            st["fps_measured"] = dticks / dt_fps
            st["draws_per_frame"] = (float(ddraws) / dticks) if dticks else 0.0
            st["last_fps_t"] = secs
            st["last_fps_draws"] = st["draws"]
            st["last_fps_ticks"] = st["ticks"]

        doc = Rhino.RhinoDoc.ActiveDoc
        if doc is not None:
            doc.Views.Redraw()

    timer = wf.Timer()
    timer.Interval = int(max(10, round(1000.0 / float(fps))))
    timer.Tick += on_tick
    timer.Start()

    # Windows 타이머는 시스템 틱(15.625 ms) 배수로 스냅된다. 40 ms 를 요청하면
    # 실제로는 46.9 ms 로 돌아 21.3 Hz 가 된다(실측 21.2). 그래서 요청값과
    # 실효값을 같이 적는다 — HUD 의 fps 가 낮게 보이는 것이 버그가 아니다.
    snapped = 15.625 * max(1.0, round(timer.Interval / 15.625))
    info_extra = [
        "",
        "재생 중 — 뷰포트에 직접 그린다 (GH 프리뷰가 아니다)",
        "  타이머 {} ms 요청 -> 실효 {:.1f} ms ({:.1f} fps)".format(
            timer.Interval, snapped, 1000.0 / snapped),
        "             <- Windows 타이머는 15.625 ms 배수로 스냅된다",
        "  배속 x{:.1f}  반복 {}  남의 프리뷰 {}개 끔".format(
            float(time_scale), "예" if loop else "아니오",
            max(0, len(state["hidden_prev"]) - 1)),
        "  play 를 끄면 그 자리에 멈춘 그림이 남는다",
        "",
        "재생 시각은 매 틱마다 스톱워치에서 다시 계산한다 — 프레임을 놓쳐도",
        "누적 오차가 생기지 않는다 (실측: 6.1초 구간에서 오차 0.5%)",
    ]
else:
    info_extra = [
        "",
        "일시정지 — t={:.2f} s 시점을 뷰포트에 그린다 (슬라이더로 스크럽)".format(
            float(t)),
        "  컨듀잇은 켜져 있다. GH 프리뷰가 아니라 이쪽이 그린다 —",
        "  GH 프리뷰는 메시 와이어를 다 그려서 12만 면이 철망으로 보인다",
        "  play 를 켜면 벽시계 시간으로 돈다",
    ]

# handler·conduit·timer 를 함께 담아 둔다 — 델리게이트만 남기면 GC 대상이 된다
sc.sticky[KEY] = {"conduit": conduit, "timer": timer, "state": state,
                  "handler": (on_tick if running else None),
                  "hidden_prev": state["hidden_prev"]}


# ── 리포트 ──────────────────────────────────────────────

lines = [
    "AMv1 Play",
    "=" * 44,
]

if not pin_bases and not pose_list:
    lines.append("입력이 없다 — Inspect 의 pin_tops, Robot 의 poses 를 연결하세요.")
else:
    if pin_bases:
        lines.append("핀:          {}개  격자 {}x{}  출발 {:.0f} mm".format(
            len(pin_bases), NX, NY, float(pin_home)))
        lines.append("             <- 격자 크기는 점 순서에서 유도했다")
    if pose_list:
        lines.append("로봇 포즈:   {}개".format(len(pose_list)))
        lines.append("베이스:      원점 ({:.0f}, {:.0f}, {:.0f})  방향 ({:+.2f}, {:+.2f})".format(
            robot_plane.Origin.X, robot_plane.Origin.Y, robot_plane.Origin.Z,
            robot_plane.XAxis.X, robot_plane.XAxis.Y))
        if robot_plane_given:
            lines.append("             <- AMv1 Base 에서 온 것")
        else:
            lines.append("** robot_plane 이 없어 WorldXY 로 그렸다 — 로봇이 엉뚱한")
            lines.append("   곳에 있다. AMv1 Base 의 plane 을 연결하세요.")

    if PARTS:
        lines.append("실물 형상:   파트 {}개  면 {:,}개  ({})".format(
            len(PARTS), rbb.face_count(PARTS), parts_note))
        lines.append("             <- 메시를 복제하지 않고 좌표계를 옮겨 그린다")
    else:
        lines.append("실물 형상:   없음 — {}".format(parts_note))

    lines.append("")
    lines.append("판정 (AMv1 Check 에서 받은 것):")
    if warn:
        for w in warn:
            lines.append("  - {}".format(w))
    else:
        lines.append("  ** 없다 — Check 의 warn 을 연결하세요.")
        lines.append("     안 물리면 못 가는 위치도 되는 것처럼 보인다")
    lines.append("  문제 구간 {}개".format(len(BAD)))
    lines.append("  <- 도달·기구·간섭의 자세한 숫자는 AMv1 Check 의 report 에 있다")
    lines.append("")
    lines.append(pb.report(timeline, show_reach=False))
    lines.append("")
    lines.append("현재:        {:.2f} s  {}  {:.0f}%".format(
        s0["t"], s0["phase"], s0["progress"] * 100.0))

if step_mismatch:
    lines += [
        "",
        "** 포즈 {}개 != 타겟 {}개 — AMv1 Robot 이 step>1 로 돌았다.".format(
            len(pose_list), len(tgts)),
        "   어느 포즈가 어느 타겟인지 알 수 없으므로 이송 시간을 못 쓰고",
        "   관절 시간만 썼다. 시간이 실제보다 짧게 나온다.",
        "   step=1 로 다시 계산할 것.",
    ]

lines += info_extra
info = "\n".join(lines)
# ---------- end amv1_play ----------
